# Grasshopper definition 20230214_DigitalTwinForHops_ForMeftah.ghx (Grasshopper 1.0.7)
# plug-ins: TT Toolbox

# ---- group: Get Simulation ID
id_sim = GetNumber(AtLeast=1, AtMost=1, Maximum=1.797693135e+308, Minimum=-1.797693135e+308, TreeAccess=False)
num = Number(id_sim)

# ----
panel = Panel("""Worksheet 01: FacilityBased
Worksheet 02: OccupancyBased""")
worksheet = Slider(1, range=1..2)
file_path = FilePath("H:\MIZZOU\_MotherFolderAmanWorks\Research With Dr Jong Bum\_2022-2023_AT&T_DigitalTwin\_WorkUpdates_DigitalTwinResearch_AT&T\_Spring23Works\20230205_Final_Iteration&AutomationUsingHops\20230207_DT_variables_2WorksheetsForGH.xlsx")
read_excel_sheet = ReadExcelSheet(Run=Toggle(True), FilePath=file_path, Worksheet=worksheet, Listen=False)  # -> UserMessages, Columns, Rows
panel_2 = Panel(file_path)
bang = ExplodeTree(Data=Tree({1}: ["0", "1", "2", "3", "4", "5"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], {2}: ["0", "0", "0", "0", "0", "0"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], {3}: ["0", "0", "0", "0", "0", "0"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], {4}: ["0.29924608544365", "0.29924608544365", "0.29924608544365", "0.29924608544365", "0.29924608544365", "0.29924608544365"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], {5}: ["0.495762711864407", "0.495762711864407", "0.495762711864407", "0.495762711864407", "0.495762711864407", "0.495762711864407"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]))  # -> Branch0, Branch1, Branch2, Branch3, Branch4
panel_3 = Panel(bang.Branch1)
id = Slider(743, range=0..743)
item = ListItem(List=[bang.Branch1, bang.Branch2, bang.Branch3, bang.Branch4], Index=num, Wrap=True)
panel_4 = Panel(item)
bang_2 = ExplodeTree(Data=item)  # -> flatten(Branch0), flatten(Branch1), flatten(Branch2), flatten(Branch3)
equipmentloadperarea = Number(bang_2.Branch2)
lightingperarea = Number(bang_2.Branch1)
peopleperarea = Number(bang_2.Branch0)
ach = Number(bang_2.Branch3)
panel_5 = Panel(equipmentloadperarea)

# ----
# Create New ProgramType
panel_6 = Panel("SchoolSecondary HTGSETP_SCH_YES_OPTIMUM")
panel_7 = Panel("0.05")
panel_8 = Panel("0.01")
panel_9 = Panel("6")
panel_10 = Panel("5")
setpoint = HBSetpoint(name="University Setpoint", heating_sch=panel_6, cooling_sch="SchoolSecondary CLGSETP_SCH_NO_SETBACK")  # -> setpoint; plug-in component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
lighting = HBLighting(name="University Lighting", watts_per_area=lightingperarea, schedule="SchoolPrimary BLDG_LIGHT_GYM_SCH", baseline="10")  # -> lighting; plug-in component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
ventilation = HBVentilation(name="University Ventilation", flow_per_person=0, flow_per_area=0, flow_per_zone=0, ach=ach)  # -> vent; plug-in component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
people = HBPeople(name="University People", ppl_per_area=peopleperarea, occupancy_sch="PrimarySchool Bldg Occ")  # -> people; plug-in component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
infiltration = HBInfiltration(name="University Infiltration", flow_per_ext_area="0.0003")  # -> infil; plug-in component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
equipment = HBEquipment(name="University Equipment", watts_per_area=equipmentloadperarea, schedule="SchoolPrimary BLDG_EQUIP_SCH_2010")  # -> equip; plug-in component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
programtype = HBProgramType(
    name="Steelcase Studio",
    people=people,
    lighting=lighting,
    electric_equip=equipment,
    infiltration=infiltration,
    ventilation=ventilation,
    setpoint=setpoint)  # -> program; plug-in component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

# ----
# Browse ConstructionSets
# Search Construction/Material Libraries
# Create Weekly Schedule
dayschedule = HBDaySchedule(
    Decimals=1,
    Maximum=1,
    Minimum=0,
    Value=[0, 0, 0, 0, 0, 0, 0, 0, 0, 0.1, 0.3, 0.3, 0.3, 0.3, 0.3, 0.3, 0.2, 0.1, 0, 0, 0, 0, 0, 0])
# Deconstruct ConstructionSet, Constructions, Materials
dayschedule_2 = HBDaySchedule(
    Decimals=1,
    Maximum=1,
    Minimum=0,
    Value=[0, 0, 0, 0, 0, 0, 0, 0.1, 0.8, 1, 1, 1, 1, 1, 1, 1, 1, 0.8, 0.3, 0.3, 0.1, 0, 0, 0])
weeklyschedule = HBWeeklySchedule(
    sun="0",
    mon=dayschedule_2,
    tue=dayschedule_2,
    wed=dayschedule_2,
    thu=dayschedule_2,
    fri=dayschedule_2,
    sat=dayschedule,
    name="Office Occ Normal")  # -> report, schedule, idf_year, idf_week, idf_days; plug-in component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

# ----
# CreatingBuildingSchedule
# (We can collect sensor data as Inputs)
# Create Constant (Repeating Daily) Schedule
dayschedule_3 = HBDaySchedule(
    Decimals=1,
    Maximum=1,
    Minimum=0,
    Value=[0, 0, 0, 0, 0, 0, 0, 0.1, 0.8, 1, 1, 1, 1, 1, 1, 1, 1, 0.8, 0.3, 0.3, 0.1, 0, 0, 0])
constantschedule = HBConstantSchedule(values=dayschedule_3, name="Office Occ Deadline")  # -> report, schedule, idf_text; plug-in component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
genepooltodaysch = HBGenePoolToDaySchedule(gene_pool=dayschedule_3, run=Toggle(False))  # -> report; plug-in component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

# ----
# Create Seasonal Schedule
panel_11 = Panel("6")
analysisperiod = LBAnalysisPeriod(start_month=panel_11, start_day=1, start_hour=0, end_month=panel_11)  # -> period, hoys, dates; plug-in component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
seasonalschedule = HBSeasonalSchedule(
    base_schedule=weeklyschedule.schedule,
    season_scheds=constantschedule.schedule,
    analysis_periods=analysisperiod.period,
    name="Office Occ w/ Deadline")  # -> report, schedule, idf_year, idf_week, idf_days; plug-in component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
panel_12 = Panel(seasonalschedule.schedule)

# ----
# Create Fixed Interval Schedule
cluster = Cluster()  # -> D, S_2, D_2, S
data = Data([cluster.D, cluster.S_2, cluster.D_2, cluster.S])
fixedintervalschedule = HBFixedIntervalSchedule(values=data, name="Gradual Transparency Shift")  # -> report, schedule; plug-in component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
panel_13 = Panel(fixedintervalschedule.schedule)
# Create Materials
panel_14 = Panel(data)

# ---- group: Dynamically Chage Glazing Ratio
number_slider = Slider(3, range=1..9, expression="x * 0.1")

# ----
# Create Honeybee Model
panel_15 = Panel("outdoors")
geo = Geometry(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)
geo_2 = Geometry(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)
face = HBFace(geo=geo, bc=panel_15)  # -> report, faces; plug-in component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
face_2 = HBFace(geo=geo_2, bc="adiabatic")  # -> report, faces; plug-in component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
panel_16 = Panel("2013::LargeOffice::OpenOffice")
aperturesbyratio = HBAperturesByRatio(hb_objs=flatten(face.faces), ratio=number_slider)  # -> report, hb_objs; plug-in component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
all_air = HBAllAirHVACTemplates({"VAV chiller with gas boiler reheat": "VAV_Chiller_Boiler", "VAV chiller with central air source heat pump reheat": "VAV_Chiller_ASHP", "VAV chiller with district hot water reheat": "VAV_Chiller_DHW", "VAV chiller with PFP boxes": "VAV_Chiller_PFP", "VAV chiller with gas coil reheat": "VAV_Chiller_GasCoil", "VAV air-cooled chiller with gas boiler reheat": "VAV_ACChiller_Boiler", "VAV air-cooled chiller with central air source heat pump reheat": "VAV_ACChiller_ASHP", "VAV air-cooled chiller with district hot water reheat": "VAV_ACChiller_DHW", "VAV air-cooled chiller with PFP boxes": "VAV_ACChiller_PFP", "VAV air-cooled chiller with gas coil reheat": "VAV_ACChiller_GasCoil"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}, selected="VAV chiller with gas boiler reheat")
room = HBRoom(
    faces=flatten([face_2.faces, aperturesbyratio.hb_objs]),
    name="Office Shoe Box",
    constr_set="2013::ClimateZone5::SteelFramed",
    program=programtype,
    conditioned=True)  # -> report, room; plug-in component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
concat = Concatenate(FragmentA="ShoeBox", FragmentB=number_slider)
allairhvac = HBAllAirHVAC(rooms=flatten(room.room), system_type=all_air, name="VAV System", economizer="DifferentialDryBulb")  # -> report, rooms; plug-in component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
daylightcontrol = HBApplyDaylightControl(rooms=flatten(allairhvac.rooms))  # -> report, rooms; plug-in component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
model = HBModel(rooms=flatten(daylightcontrol.rooms), name=concat)  # -> report, model; plug-in component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

# ----
# Request Outputs
toggle = BooleanToggle(True)
simoutput = HBSimulationOutput(zone_energy_use=toggle, hvac_energy_use=toggle)  # -> report, sim_output; plug-in component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
simpar = HBSimulationParameter(output=simoutput.sim_output, timestep=6)  # -> sim_par; plug-in component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

# ----
# Download EPW File
panel_17 = Panel("https://github.com/amanjayedi/2022_Digital-Twin_5G/blob/main/_FinalWorkingScripts/Weather%20Data%20Scrapping/USA_MO_EastCampusStation_KMOCOLUM288_TMY3.zip")
downloadepw = LBDownloadWeather(weather_URL=panel_17)  # -> epw_file, stat_file, ddy_file; plug-in component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

file_path_2 = FilePath("C:\Users\ja2qm\Downloads\USA_MO_EastCampusStation_KMOCOLUM288_TMY3\USA_MO_EastCampusStation_KMOCOLUM288_TMY3EPWCSV.epw")

# ----
# Deconstruct Schedues
panel_18 = Panel("Monday")
schtodata = HBScheduleToData(schedule=weeklyschedule.schedule, week_start_day=panel_18, holidays="1 Jan")  # -> data; plug-in component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
deconstrsch = HBDeconstructSchedule(schedule=weeklyschedule.schedule)  # -> day_names, day_data, type_limit; plug-in component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

# ----
# Create ScheduleTypeLimits
panel_19 = Panel("Fan Speed")
typelimit = HBTypeLimit(name=panel_19, low_limit="0", unit_type="Velocity")  # -> report, type_limit; plug-in component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
panel_20 = Panel(typelimit.type_limit)

# ----
# Search Schedule Library
searchschs = HBSearchSchedules()  # -> schedules, type_limits; plug-in component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
panel_21 = Panel(searchschs.schedules)

# ----
# Assign Schedues
applyroomsch = HBApplyRoomSchedules()  # -> report, mod_obj; plug-in component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
applyshadesch = HBApplyShadeSchedule()  # -> hb_objs; plug-in component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

# ----
# EnergyPlus documentation
# https://energyplus.net/assets/nrel_custom/pdfs/pdfs_v9.6.0/InputOutputReference.pdf
toggle_2 = BooleanToggle(True)
modeltoosm = HBModelToOSM(model=model.model, epw_file=file_path_2, sim_par=simpar, write=toggle_2, run=toggle_2)  # -> report, jsons, osw, osm, idf, sql, zsz, rdd, html; plug-in component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

# ----
# Compute EUI
eui = HBEndUseIntensity(sql=modeltoosm.sql)  # -> eui, eui_end_use, end_uses, gross_floor; plug-in component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
eui_kwh_m2 = Panel(eui.eui)
panel_22 = Panel(eui.eui_end_use)
panel_23 = Panel(eui.end_uses)

# ---- group: Carbon Factor
multiplication = Multiplication(A=eui.eui, B="0.69")

# ---- group: Operational Carbon Per Hour ( (lb CO2/m2)
division = Division(A=multiplication, B="8760")

# ----
# File paths to data from the NCDC
# (request data from https://gis.ncdc.noaa.gov/maps/ncei/cdo/hourly)
panel_24 = Panel("258")
multiplication_2 = Multiplication(A=division, B=panel_24)
operationalcarbon_lb_co2_per_hour = Panel(multiplication_2)

# ---- group: RH_OUT:emissions_carbon
num_2 = Number(multiplication_2)

# ==== cluster Cluster
division = Division(A="1", B="2190")
neg = Negative(Value=division)
dup = DuplicateData(Data="0", Number="2190", Order=True)
dup_2 = DuplicateData(Data="1", Number="2190", Order=True)
series = Series(Start="1", Step=neg, Count="2190")
series_2 = Series(Start=0, Step=division, Count="2190")
S = ClusterOutput(series)
S_2 = ClusterOutput(series_2)
D = ClusterOutput(dup)
D_2 = ClusterOutput(dup_2)
