# Grasshopper definition 20230205_DigitalTwinForCo2.gh (Grasshopper 1.0.7)
# plug-ins: TT Toolbox

watts_per_area = Slider(5, range=1..10)
ppl_per_area = Slider(1, range=1..10)
watts_per_area_2 = Slider(10, range=1..10)

# ----
# Testbed Schedule Based on Sensor Data
panel = Panel("SchoolSecondary HTGSETP_SCH_YES_OPTIMUM")

# ---- group: Dynamically Chage Glazing Ratio
number_slider = Slider(3, range=1..9, expression="x * 0.1")

# ----
# Request Outputs
toggle = BooleanToggle(True)
simoutput = HBSimulationOutput(zone_energy_use=toggle, hvac_energy_use=toggle)  # -> report, sim_output; plug-in component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
simpar = HBSimulationParameter(output=simoutput.sim_output, timestep=6)  # -> sim_par; plug-in component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

# ----
# Download EPW File
panel_2 = Panel("https://energyplus-weather.s3.amazonaws.com/north_and_central_america_wmo_region_4/USA/MO/USA_MO_Columbia.Rgnl.AP.724450_TMY3/USA_MO_Columbia.Rgnl.AP.724450_TMY3.zip")
downloadepw = LBDownloadWeather(weather_URL=panel_2)  # -> epw_file, stat_file, ddy_file; plug-in component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

worksheet = Slider(1, range=1..2)
file_path = FilePath("H:\MIZZOU\_MotherFolderAmanWorks\Research With Dr Jong Bum\_2022-2023_AT&T_DigitalTwin\_WorkUpdates_DigitalTwinResearch_AT&T\_Spring23Works\20230123_DigitalTwinScript\digitaltwin744.xlsx")
read_excel_sheet = ReadExcelSheet(Run=Toggle(True), FilePath=file_path, Worksheet=worksheet, Listen=False)  # -> UserMessages, Columns, Rows
panel_3 = Panel(file_path)
bang = ExplodeTree(Data=read_excel_sheet.Columns)  # -> Branch0, Branch1, Branch2, Branch3
panel_4 = Panel(bang.Branch3)
id = Slider(743, range=0..743)
item = ListItem(List=[bang.Branch1, bang.Branch2, bang.Branch3], Index=id, Wrap=True)
panel_5 = Panel(item)
bang_2 = ExplodeTree(Data=item)  # -> flatten(Branch0), flatten(Branch1), flatten(Branch2)
equipmentloadperarea = Number(bang_2.Branch2)
lightingperarea = Number(bang_2.Branch1)
peopleperarea = Number(bang_2.Branch0)
panel_6 = Panel(equipmentloadperarea)
number_slider_2 = Slider(0.5, range=0..1)
division = Division(A=peopleperarea, B=100)
toggle_2 = BooleanToggle(True)

setpoint = HBSetpoint(name="University Setpoint", heating_sch=panel, cooling_sch="SchoolSecondary CLGSETP_SCH_NO_SETBACK")  # -> setpoint; plug-in component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
lighting = HBLighting(name="University Lighting", watts_per_area=lightingperarea, schedule="SchoolPrimary BLDG_LIGHT_GYM_SCH", baseline="10")  # -> lighting; plug-in component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
ventilation = HBVentilation(name="University Ventilation", flow_per_person="0.01")  # -> vent; plug-in component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
people = HBPeople(name="University People", ppl_per_area=division, occupancy_sch="PrimarySchool Bldg Occ")  # -> people; plug-in component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
infiltration = HBInfiltration(name="University Infiltration", flow_per_ext_area="0.0003")  # -> infil; plug-in component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
equipment = HBEquipment(name="University Equipment", watts_per_area=equipmentloadperarea, schedule="SchoolPrimary BLDG_EQUIP_SCH_2010")  # -> equip; plug-in component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

programtype = HBProgramType(
    name="Stanley Testbed",
    people=people,
    lighting=lighting,
    electric_equip=equipment,
    infiltration=infiltration,
    ventilation=ventilation,
    setpoint=setpoint)  # -> program; plug-in component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

# ----
# Create Honeybee Model
panel_7 = Panel("outdoors")
geo = Geometry(<brep referenced from the Rhino model>)
geo_2 = Geometry(<brep referenced from the Rhino model>)
face = HBFace(geo=geo, bc=panel_7)  # -> report, faces; plug-in component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
face_2 = HBFace(geo=geo_2, bc="adiabatic")  # -> report, faces; plug-in component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
panel_8 = Panel("2013::LargeOffice::OpenOffice")
aperturesbyratio = HBAperturesByRatio(hb_objs=flatten(face.faces), ratio=number_slider)  # -> report, hb_objs; plug-in component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
all_air = HBAllAirHVACTemplates({"VAV chiller with gas boiler reheat": "VAV_Chiller_Boiler", "VAV chiller with central air source heat pump reheat": "VAV_Chiller_ASHP", "VAV chiller with district hot water reheat": "VAV_Chiller_DHW", "VAV chiller with PFP boxes": "VAV_Chiller_PFP", "VAV chiller with gas coil reheat": "VAV_Chiller_GasCoil", "VAV air-cooled chiller with gas boiler reheat": "VAV_ACChiller_Boiler", "VAV air-cooled chiller with central air source heat pump reheat": "VAV_ACChiller_ASHP", "VAV air-cooled chiller with district hot water reheat": "VAV_ACChiller_DHW", "VAV air-cooled chiller with PFP boxes": "VAV_ACChiller_PFP", "VAV air-cooled chiller with gas coil reheat": "VAV_ACChiller_GasCoil"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}, selected="VAV chiller with gas boiler reheat")
room = HBRoom(
    faces=flatten([face_2.faces, aperturesbyratio.hb_objs]),
    name="Office Shoe Box",
    constr_set="2013::ClimateZone5::SteelFramed",
    program=programtype,
    conditioned=True)  # -> report, room; plug-in component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
concat = Concatenate(FragmentA="ShoeBox", FragmentB=number_slider)
allairhvac = HBAllAirHVAC(rooms=flatten(room.room), system_type=all_air, name="VAV System", economizer="DifferentialDryBulb")  # -> report, rooms; plug-in component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
daylightcontrol = HBApplyDaylightControl(rooms=flatten(allairhvac.rooms))  # -> report, rooms; plug-in component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
model = HBModel(rooms=flatten(daylightcontrol.rooms), name=concat)  # -> report, model; plug-in component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

modeltoosm = HBModelToOSM(model=model.model, epw_file=downloadepw.epw_file, sim_par=simpar, write=toggle_2, run=toggle_2)  # -> report, jsons, osw, osm, idf, sql, zsz, rdd, html; plug-in component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

# ----
# Compute EUI
eui = HBEndUseIntensity(sql=modeltoosm.sql)  # -> eui, eui_end_use, end_uses, gross_floor; plug-in component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
eui_kwh_m2 = Panel(eui.eui)
panel_9 = Panel(eui.eui_end_use)
panel_10 = Panel(eui.end_uses)

# ----
# Visualize Results
roomenergyresult = HBReadRoomEnergyResult(sql=modeltoosm.sql)  # -> cooling, heating, lighting, electric_equip, gas_equip, process, hot_water, fan_electric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; plug-in component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
hourlyplot = LBHourlyPlot(data=[roomenergyresult.cooling, roomenergyresult.heating])  # -> report, mesh, legend, borders, labels, title; plug-in component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

# ---- group: Carbon Factor
panel_11 = Panel("0.69")
multiplication = Multiplication(A=eui_kwh_m2, B=panel_11)

# ---- group: Operational Carbon Per Hour ( (lb CO2/m2)
panel_12 = Panel("8760")
division_2 = Division(A=multiplication, B=panel_12)

# ---- group: Operational Carbon per Hour (lb CO2)
geo_3 = Geometry(<brep referenced from the Rhino model>)
area = Area(Geometry=geo_3)  # -> Area, Centroid
multiplication_2 = Multiplication(A=division_2, B=area.Area)

# ----
# Create New ConstructionSet
# Apply Constructions
# to Objects
python = GhPythonScript(EUI=eui_kwh_m2, carbon_factor=panel_11, hours=panel_12, area=area.Area)  # -> out, carbon_per_anum, carbon_per_hour_sqm, carbon_per_hour_total, operational_carbon
# ---------- python: Python ----------
__author__ = "ja2qm"
__version__ = "2023.01.26"

import rhinoscriptsyntax as rs


carbon_per_anum = EUI * carbon_factor
carbon_per_hour_sqm = carbon_per_anum/hours
carbon_per_hour_total = carbon_per_hour_sqm * area

if carbon_per_hour_total > 1.5:
    operational_carbon = carbon_per_hour_total
    
else:
    operational_carbon = "We have very low amount of carbon emissions happening in steelcase studio...therefore, negligible"
# ---------- end python ----------
# Create Constructions
panel_13 = Panel(python.operational_carbon)
operationalcarbon_lb_co2_per_hour = Panel(multiplication_2)
