# Grasshopper definition 20220715_DigitalTwinForCo2.gh (Grasshopper 1.0.7)
# plug-ins: TT Toolbox, Crow, Wallacei, Bifocals, Sampler, Colibri, DeCodingSpaces

file_path = FilePath("C:\20210303_compiled\foo.xlsx")
read_excel_sheet = ReadExcelSheet(Run=Toggle(True), FilePath=file_path, Worksheet="1", Listen=False)  # -> UserMessages, Columns, Rows
panel = Panel(read_excel_sheet.Columns)
split_tree = SplitTree(Data=read_excel_sheet.Columns, Masks=flatten("{1 to 9}"))  # -> simplify(Positive), simplify(Negative)
panel_2 = Panel(split_tree.Negative)

height = Panel("""70.8331132
18.85372981
71.35592146
40.9114421
49.83351095
42.30039659
35.33604415
14.07573579
25.06283128
94.11175476
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""")
radiation = Panel("""480.828786
1067.579359
1073.480847
729.819331
830.5329
745.49804
666.883464
426.894131
550.918005
1330.351912
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""")

path = FilePath("C:\Users\ja2qm\Downloads\JSONExample.json")
path_2 = FilePath("C:\Users\ja2qm\Downloads\Example.json")
json = PythonScript(FilePath=path)  # -> out
# ---------- json: Python ----------
#Written by Aman, J.
#Date: 20220620
import json

if FilePath:
    
    # JSON file to read
    file = open(FilePath)
    
    # Load the data
    data = json.load(file)
    
    # Do something with the data
    print data
# ---------- end json ----------
bang = ExplodeTree(Data=flatten(json))  # -> Branch0, Branch1, Branch2
json_2 = PythonScript(FilePath=path_2)  # -> out
# ---------- json_2: Python ----------
import json

if FilePath:
    
    # JSON file to read
    file = open(FilePath)
    
    # Load the data
    data = json.load(file)
    
    # Do something with the data
    print data
# ---------- end json_2 ----------
bang_2 = ExplodeTree(Data=flatten(json_2))  # -> Branch0, Branch1, Branch2
panel_3 = Panel(json)
panel_4 = Panel(json_2)

# ----
# Create New ConstructionSet
interiorsubset = HBInteriorConstructionSubset()  # -> interior_set; plug-in component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
# CreatingBuildingProgram
# (We can collect sensor data as Inputs)
subfacesubset = HBSubfaceSubset()  # -> subface_set; plug-in component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
# CreatingConstructionIncludingMaterial
# (We can collect that from Revit)
exteriorsubset = HBExteriorConstructionSubset()  # -> exterior_set; plug-in component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
groundsubset = HBGroundConstructionSubset()  # -> ground_set; plug-in component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
constructionset = HBConstructionSet(
    name="CustomSet",
    exterior_subset=exteriorsubset,
    ground_subset=groundsubset,
    interior_subset=interiorsubset,
    subface_subset=subfacesubset)  # -> constr_set; plug-in component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

# ----
# Browse ConstructionSets
constructiontypes = HBConstructionTypes({"SteelFramed", "WoodFramed", "Mass", "Metal Building"}, selected="SteelFramed")
climatezones = HBClimateZones({"1 - Very Hot": "1", "2 - Hot": "2", "3 - Warm": "3", "4 - Mixed": "4", "5 - Cool": "5", "6 - Cold": "6", "7 - Very Cold": "7", "8 - Subarctic": "8"}, selected="5 - Cool")
searchconstrset = HBSearchConstructionSets(keywords="Generic")  # -> constr_sets; plug-in component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
constrsetclimate = HBConstructionSetByClimate(climate_zone=climatezones, constr_type=constructiontypes)  # -> constr_set; plug-in component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
panel_5 = Panel(searchconstrset)
panel_6 = Panel(constrsetclimate)

# ----
# Search Construction/Material Libraries
searchconstrs = HBSearchConstructions()  # -> opaque_constrs, window_constrs, shade_constrs; plug-in component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
searchmats = HBSearchMaterials()  # -> opaque_mats, window_mats; plug-in component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
panel_7 = Panel(searchconstrs.opaque_constrs)

# ----
# Create Weekly Schedule
dayschedule = HBDaySchedule(
    Decimals=1,
    Maximum=1,
    Minimum=0,
    Value=[0, 0, 0, 0, 0, 0, 0, 0, 0, 0.1, 0.3, 0.3, 0.3, 0.3, 0.3, 0.3, 0.2, 0.1, 0, 0, 0, 0, 0, 0])
dayschedule_2 = HBDaySchedule(
    Decimals=1,
    Maximum=1,
    Minimum=0,
    Value=[0, 0, 0, 0, 0, 0, 0, 0.1, 0.8, 1, 1, 1, 1, 1, 1, 1, 1, 0.8, 0.3, 0.3, 0.1, 0, 0, 0])
weeklyschedule = HBWeeklySchedule(
    sun="0",
    mon=dayschedule_2,
    tue=dayschedule_2,
    wed=dayschedule_2,
    thu=dayschedule_2,
    fri=dayschedule_2,
    sat=dayschedule,
    name="Office Occ Normal")  # -> report, schedule, idf_year, idf_week, idf_days; plug-in component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

# ----
# Browse ProgramTypes
bldgvintages = HBBuildingVintages({"ASHRAE 90.1 2013  |  IECC 2015": "2013", "ASHRAE 90.1 2010  |  IECC 2012": "2010", "ASHRAE 90.1 2007  |  IECC 2009": "2007", "ASHRAE 90.1 2004  |  IECC 2006": "2004", "1980-2004 (CBECS)": "1980_2004", "Pre-1980 (CBECS)": "pre_1980"}, selected="ASHRAE 90.1 2013  |  IECC 2015")
bldgprograms = HBBuildingPrograms({"LargeOffice", "MediumOffice", "SmallOffice", "MidriseApartment", "HighriseApartment", "Retail", "StripMall", "PrimarySchool", "SecondarySchool", "SmallHotel", "LargeHotel", "Hospital", "Outpatient", "Laboratory", "Warehouse", "SuperMarket", "FullServiceRestaurant", "QuickServiceRestaurant", "Courthouse", "LargeDataCenterHighITE", "LargeDataCenterLowITE", "SmallDataCenterHighITE", "SmallDataCenterLowITE"}, selected="LargeOffice")
searchprog = HBSearchPrograms(bldg_prog=bldgprograms, vintage=bldgvintages)  # -> room_prog; plug-in component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
panel_8 = Panel(searchprog)

# ----
# CreatingBuildingSchedule
# (We can collect sensor data as Inputs)
# Create Constant (Repeating Daily) Schedule
dayschedule_3 = HBDaySchedule(
    Decimals=1,
    Maximum=1,
    Minimum=0,
    Value=[0, 0, 0, 0, 0, 0, 0, 0.1, 0.8, 1, 1, 1, 1, 1, 1, 1, 1, 0.8, 0.3, 0.3, 0.1, 0, 0, 0])
constantschedule = HBConstantSchedule(values=dayschedule_3, name="Office Occ Deadline")  # -> report, schedule, idf_text; plug-in component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
genepooltodaysch = HBGenePoolToDaySchedule(gene_pool=dayschedule_3, run=Toggle(False))  # -> report; plug-in component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

# ----
# Blend ProgramTypes
panel_9 = Panel("""2013::LargeOffice::ClosedOffice
2013::LargeOffice::Conference
2013::LargeOffice::Corridor
2013::LargeOffice::IT_Room
2013::LargeOffice::OpenOffice
2013::LargeOffice::PrintRoom
2013::LargeOffice::Restroom
2013::LargeOffice::Storage""")
panel_10 = Panel("""0.05
0.15
0.2
0.05
0.4
0.05
0.05
0.05""")
blendprograms = HBBlendProgramTypes(name="Full Building Office", programs=panel_9, ratios=panel_10)  # -> program; plug-in component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

# ----
# Create New ProgramType
panel_11 = Panel("SchoolSecondary HTGSETP_SCH_YES_OPTIMUM")
setpoint = HBSetpoint(name="University Setpoint", heating_sch=panel_11, cooling_sch="SchoolSecondary CLGSETP_SCH_NO_SETBACK")  # -> setpoint; plug-in component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
lighting = HBLighting(name="University Lighting", watts_per_area="6", schedule="SchoolPrimary BLDG_LIGHT_GYM_SCH", baseline="10")  # -> lighting; plug-in component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
ventilation = HBVentilation(name="University Ventilation", flow_per_person="0.01")  # -> vent; plug-in component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
people = HBPeople(name="University People", ppl_per_area="0.05", occupancy_sch="PrimarySchool Bldg Occ")  # -> people; plug-in component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
infiltration = HBInfiltration(name="University Infiltration", flow_per_ext_area="0.0003")  # -> infil; plug-in component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
equipment = HBEquipment(name="University Equipment", watts_per_area="5", schedule="SchoolPrimary BLDG_EQUIP_SCH_2010")  # -> equip; plug-in component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
programtype = HBProgramType(
    name="University Classroom",
    people=people,
    lighting=lighting,
    electric_equip=equipment,
    infiltration=infiltration,
    ventilation=ventilation,
    setpoint=setpoint)  # -> program; plug-in component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

# ----
# Apply Constructions
# to Objects
applyopaqueconstr = HBApplyOpaqueConstruction()  # -> hb_objs; plug-in component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
applywindowconstr = HBApplyWindowConstruction()  # -> hb_objs; plug-in component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
applyshadeconstr = HBApplyShadeConstruction()  # -> hb_objs; plug-in component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
applyconstrset = HBApplyConstructionSet()  # -> rooms; plug-in component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

# ----
# Deconstruct ConstructionSet, Constructions, Materials
construction_set = Data(constrsetclimate)
decnstrconstrsetint = HBDeconstructConstructionSetInterior(constr_set=construction_set)  # -> interior_wall, ceiling, interior_floor, interior_window, interior_door, int_glass_door; plug-in component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
decnstrconstrset = HBDeconstructConstructionSet(constr_set=construction_set)  # -> exterior_wall, exterior_roof, exposed_floor, ground_wall, ground_roof, ground_floor, window, skylight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; plug-in component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
panel_12 = Panel(decnstrconstrset.exterior_wall)
panel_13 = Panel(decnstrconstrsetint.ceiling)
decnstrconstr = HBDeconstructConstruction(constr=decnstrconstrset.exterior_wall)  # -> materials, layers, r_val_si, r_val_ip, u_fac_si, u_fac_ip, shgc, t_sol, t_vis; plug-in component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
panel_14 = Panel(decnstrconstr.t_sol)
panel_15 = Panel(decnstrconstr.r_val_ip)
panel_16 = Panel(decnstrconstr.layers)
decnstrmat = HBDeconstructMaterial(mat=decnstrconstr.materials)  # -> values, attr_names, r_val_si, r_val_ip; plug-in component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
panel_17 = Panel(decnstrmat.values)
panel_18 = Panel(decnstrmat.attr_names)

# ----
# Create Seasonal Schedule
panel_19 = Panel("6")
analysisperiod = LBAnalysisPeriod(start_month=panel_19, start_day=1, start_hour=0, end_month=panel_19)  # -> period, hoys, dates; plug-in component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
seasonalschedule = HBSeasonalSchedule(
    base_schedule=weeklyschedule.schedule,
    season_scheds=constantschedule.schedule,
    analysis_periods=analysisperiod.period,
    name="Office Occ w/ Deadline")  # -> report, schedule, idf_year, idf_week, idf_days; plug-in component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
panel_20 = Panel(seasonalschedule.schedule)

# ----
# Create Constructions
panel_21 = Panel("Generic Window Argon Gap")
merge = Merge(Data1="1IN Stucco", Data2="Typical Insulation-R10", Data3="Generic Wall Air Gap", Data4="1/2 in. Gypsum Board")
merge_2 = Merge(Data1="Generic Low-e Glass", Data2=panel_21, Data3="Generic Clear Glass")
opaqueconstr = HBOpaqueConstruction(name="Custom Constr", materials=merge)  # -> constr; plug-in component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
shadeconstr = HBShadeConstruction(name="Glass Facade", sol_ref="0.3", vis_ref="0.3", specular=Toggle(True))  # -> constr; plug-in component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
windowconstr = HBWindowConstruction(name="High Insulation Glass", materials=merge_2)  # -> constr; plug-in component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
panel_22 = Panel(windowconstr)
panel_23 = Panel(shadeconstr)
panel_24 = Panel(opaqueconstr)

# ----
# Create Fixed Interval Schedule
cluster = Cluster()  # -> D, S_2, D_2, S
data = Data([cluster.D, cluster.S_2, cluster.D_2, cluster.S])
fixedintervalschedule = HBFixedIntervalSchedule(values=data, name="Gradual Transparency Shift")  # -> report, schedule; plug-in component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
panel_25 = Panel(fixedintervalschedule.schedule)
panel_26 = Panel(data)

# ----
# Assign Programs/Loads
applyprogram = HBApplyProgramType()  # -> report, rooms; plug-in component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
applyloadvals = HBApplyLoadValues()  # -> report, mod_obj; plug-in component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
applysetpointvals = HBApplySetpointValues()  # -> report, mod_obj; plug-in component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
absoluteloadvals = HBApplyAboluteLoadValues()  # -> report, rooms; plug-in component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

# ----
# Deconstruct Schedues
panel_27 = Panel("Monday")
schtodata = HBScheduleToData(schedule=weeklyschedule.schedule, week_start_day=panel_27, holidays="1 Jan")  # -> data; plug-in component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
deconstrsch = HBDeconstructSchedule(schedule=weeklyschedule.schedule)  # -> day_names, day_data, type_limit; plug-in component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

# ----
# Create ScheduleTypeLimits
panel_28 = Panel("Fan Speed")
typelimit = HBTypeLimit(name=panel_28, low_limit="0", unit_type="Velocity")  # -> report, type_limit; plug-in component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
panel_29 = Panel(typelimit.type_limit)

# ----
# Create Materials
panel_30 = Panel("Custom Window System")
panel_31 = Panel("""Argon
Air""")
panel_32 = Panel("""0.9
0.1""")
customgapmat = HBCustomWindowGapMaterial(
    name="Carbon Dioxide",
    thickness="0.0125",
    conductivity_a="0.0001",
    viscosity_a="0.000014",
    specific_heat_a="827.73",
    spec_heat_ratio="1.4",
    mol_weight="44")  # -> mat; plug-in component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
glassmat = HBGlassMaterial(name="Safety Glass", thickness="0.02")  # -> mat; plug-in component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
blindmat = HBBlindMaterial(name="WoodenBlind", slat_separation="0.03", slat_thickness="0.01", slat_angle="90", conductivity="0.14")  # -> mat; plug-in component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
shademat = HBShadeMaterial(name="InsulatingShade", thickness="0.02", conductivity="0.02")  # -> mat; plug-in component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
opaquematnomass = HBOpaqueMaterialNoMass(name="NoMassInsulation", r_value="2")  # -> mat; plug-in component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
opaquemat = HBOpaqueMaterial(name="Concrete Custom", thickness="0.25", conductivity="0.7195", density="1856", spec_heat="839.4")  # -> mat; plug-in component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
gapmat = HBWindowGapMaterial(name="Air Argon Mixture", gas_types=panel_31, gas_ratios=panel_32)  # -> mat; plug-in component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
windowmat = HBWindowMaterial(name=panel_30, u_factor="1.25", shgc="0.35")  # -> mat; plug-in component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
panel_33 = Panel(opaquematnomass)
panel_34 = Panel(windowmat)
panel_35 = Panel(customgapmat)
panel_36 = Panel(opaquemat)
panel_37 = Panel(gapmat)
panel_38 = Panel(shademat)
panel_39 = Panel(glassmat)
panel_40 = Panel(blindmat)

# ----
# Search Schedule Library
searchschs = HBSearchSchedules()  # -> schedules, type_limits; plug-in component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
panel_41 = Panel(searchschs.schedules)

# ----
# Assign Schedues
applyroomsch = HBApplyRoomSchedules()  # -> report, mod_obj; plug-in component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
applyshadesch = HBApplyShadeSchedule()  # -> hb_objs; plug-in component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

# ---- group: Dynamically Chage Glazing Ratio
number_slider = Slider(4, range=1..9, expression="x * 0.1")

# ----
# Create Honeybee Model
panel_42 = Panel("outdoors")
geo = Geometry([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])
geo_2 = Geometry(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)
face = HBFace(geo=geo, bc=panel_42)  # -> report, faces; plug-in component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
face_2 = HBFace(geo=geo_2, bc="adiabatic")  # -> report, faces; plug-in component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
aperturesbyratio = HBAperturesByRatio(hb_objs=flatten(face.faces), ratio=number_slider)  # -> report, hb_objs; plug-in component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
all_air = HBAllAirHVACTemplates({"VAV chiller with gas boiler reheat": "VAV_Chiller_Boiler", "VAV chiller with central air source heat pump reheat": "VAV_Chiller_ASHP", "VAV chiller with district hot water reheat": "VAV_Chiller_DHW", "VAV chiller with PFP boxes": "VAV_Chiller_PFP", "VAV chiller with gas coil reheat": "VAV_Chiller_GasCoil", "VAV air-cooled chiller with gas boiler reheat": "VAV_ACChiller_Boiler", "VAV air-cooled chiller with central air source heat pump reheat": "VAV_ACChiller_ASHP", "VAV air-cooled chiller with district hot water reheat": "VAV_ACChiller_DHW", "VAV air-cooled chiller with PFP boxes": "VAV_ACChiller_PFP", "VAV air-cooled chiller with gas coil reheat": "VAV_ACChiller_GasCoil"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}, selected="VAV chiller with gas boiler reheat")
room = HBRoom(
    faces=flatten([face_2.faces, aperturesbyratio.hb_objs]),
    name="Office Shoe Box",
    constr_set="2013::ClimateZone5::SteelFramed",
    program="2013::LargeOffice::OpenOffice",
    conditioned=True)  # -> report, room; plug-in component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
concat = Concatenate(FragmentA="ShoeBox", FragmentB=number_slider)
allairhvac = HBAllAirHVAC(rooms=flatten(room.room), system_type=all_air, name="VAV System", economizer="DifferentialDryBulb")  # -> report, rooms; plug-in component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
daylightcontrol = HBApplyDaylightControl(rooms=flatten(allairhvac.rooms))  # -> report, rooms; plug-in component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
model = HBModel(rooms=flatten(daylightcontrol.rooms), name=concat)  # -> report, model; plug-in component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

# ----
# Request Outputs
toggle = BooleanToggle(True)
simoutput = HBSimulationOutput(zone_energy_use=toggle, hvac_energy_use=toggle)  # -> report, sim_output; plug-in component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
simpar = HBSimulationParameter(output=simoutput.sim_output, timestep=6)  # -> sim_par; plug-in component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

# ----
# Download EPW File
panel_43 = Panel("https://energyplus-weather.s3.amazonaws.com/north_and_central_america_wmo_region_4/USA/MA/USA_MA_Boston-Logan.Intl.AP.725090_TMY3/USA_MA_Boston-Logan.Intl.AP.725090_TMY3.zip")
downloadepw = LBDownloadWeather(weather_URL=panel_43)  # -> epw_file, stat_file, ddy_file; plug-in component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

toggle_2 = BooleanToggle(True)
modeltoosm = HBModelToOSM(model=model.model, epw_file=downloadepw.epw_file, sim_par=simpar, write=toggle_2, run=toggle_2)  # -> report, jsons, osw, osm, idf, sql, zsz, rdd, html; plug-in component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

# ----
# Compute EUI
eui = HBEndUseIntensity(sql=modeltoosm.sql)  # -> eui, eui_end_use, end_uses, gross_floor; plug-in component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
eui_kwh_m2 = Panel(eui.eui)
panel_44 = Panel(eui.eui_end_use)
panel_45 = Panel(eui.end_uses)

# ----
# Visualize Results
roomenergyresult = HBReadRoomEnergyResult(sql=modeltoosm.sql)  # -> cooling, heating, lighting, electric_equip, gas_equip, process, hot_water, fan_electric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; plug-in component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
hourlyplot = LBHourlyPlot(data=[roomenergyresult.cooling, roomenergyresult.heating])  # -> report, mesh, legend, borders, labels, title; plug-in component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

multiplication = Multiplication(A=eui_kwh_m2, B="0.69")
panel_46 = Panel(multiplication)

# ----
# Add your weather file here
# DataNormalization_Denormalization: https://martinfournier.com/how-to-normalize-and-denormalize-data-between-0-and-1/
# 
# ($inputvalue – $min) / ($max – $min)
# 
# ($normalizedValue * ($max-$min) + $min)
# ReadingExcel-Sampling-ANN-MOO-Normalization
# DataNormalization_Denormalization: https://martinfournier.com/how-to-normalize-and-denormalize-data-between-0-and-1/
# 
# ($inputvalue – $min) / ($max – $min)
# 
# ($normalizedValue * ($max-$min) + $min)
number_slider_2 = Slider(0, range=0..100)
buildingheight = Slider(10, range=10..100)
ladybug = Ladybug_Ladybug()  # -> Vviiiiiiiiiizzz; plug-in component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
epw_file = FilePath("C:\Users\ja2qm\Downloads\USA_MO_Kaiser-Lee.Fine.Mem.AWOS.724459_TMY3.epw")
curve = Curve(<curve referenced from the Rhino model>)
panel_47 = Panel("""12,24,36,48
0,.25,.5,.75,1""")
gencumulativeskymtx = Ladybug_GenCumulativeSkyMtx(epwFile=epw_file, skyDensity=0, useOldRes=True, runIt=Toggle(True))  # -> readMe, cumulativeSkyMtx; plug-in component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
unit_z = UnitZ(Factor=Slider(80, range=0..100))
extrude = Extrude(Base=curve, Direction=unit_z)
selectskymtx = Ladybug_selectSkyMtx(cumulativeSkyMtx=gencumulativeskymtx.cumulativeSkyMtx, removeDiffuse=False, removeDirect=False)  # -> readMe, selectedSkyMtx; plug-in component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
cap_holes = CapHoles(Brep=extrude)
radiationanalysis = Ladybug_RadiationAnalysis(
    north=0,
    geometry=flatten(cap_holes),
    disFromBase=Slider(0.01, range=0..0.01),
    selectedSkyMtx=flatten(selectskymtx.selectedSkyMtx),
    parallel=Toggle(True),
    runIt=Toggle(True))  # -> readMe, contextMesh, analysisMesh, testPts, testVec, port, radiationResult, radiationMesh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; plug-in component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
file_path_2 = FilePath("C:\Users\ja2qm\Downloads\DRKim\flr_out.csv")
file_path_3 = FilePath("C:\Users\ja2qm\Downloads\DRKim\flr_in.csv")
read_excel_sheet_2 = ReadExcelSheet(Run=Toggle(True), FilePath=file_path_2, Worksheet="1", Listen=False)  # -> UserMessages, Columns, Rows
multiplication_2 = Multiplication(A=radiationanalysis.totalRadiation, B=100)
read_excel_sheet_3 = ReadExcelSheet(Run=Toggle(True), FilePath=file_path_3, Worksheet="1", Listen=False)  # -> UserMessages, Columns, Rows
panel_48 = Panel(read_excel_sheet_2.Rows)
panel_49 = Panel(read_excel_sheet_3.Rows)
colibri_parameters = ColibriParameters(Radiation=flatten(multiplication_2))
panel_50 = Panel(multiplication_2)
panel_51 = Panel("""70
10
70
40
40
40
30
10
20
90
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""")
panel_52 = Panel("""70.8331132
18.85372981
71.35592146
40.9114421
49.83351095
42.30039659
35.33604415
14.07573579
25.06283128
94.11175476
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""")
buildingheight_2 = Panel("""1
2
3
4
5
6
7
8
9
10
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""")
ceilingheight = Panel("""0
0
0
0
0
0
0
0
0
10
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""")
ghpython_script = GhPythonScript(x=panel_52, y=Slider(10, range=0..10), z=panel_52)  # -> out, round_value, round_value_dev_y, ex; inputs x: Int32, z: list
# ---------- ghpython_script: Python ----------
__author__ = "ja2qm"
__version__ = "2021.03.17"

import rhinoscriptsyntax as rs
import math



round_value = (x - x %y)
round_value_dev_y = (x - x %y)/y



ex_temp = []

for i in range (len(z)):
    ex_temp.append(z[i]-(z[i]%y))

ex = ex_temp
# ---------- end ghpython_script ----------
panel_53 = Panel(ghpython_script.ex)
number_slider_3 = Slider(0.87, range=0..2)
workprediction = Panel("SolarRadiation, SurfaceArea, L-shaped")
ghpython_script_2 = GhPythonScript(variable=panel_52)  # -> out, minimum, maximum, simplify(graft(normalized)); inputs variable: list
# ---------- ghpython_script_2: Python ----------
__author__ = "ja2qm"
__version__ = "2021.03.17"

import rhinoscriptsyntax as rs
import math


"""
minimum_temp = []
for i in range(len(variable)):
    minimum_temp.append(min(variable[i]))

minimum = minimum_temp
"""

minimum = min(variable)
maximum = max(variable)
#normalized = (variable - minimum) / (maximum - minimum)


normalized_temp = []
for i in range(len(variable)):
    normalized_temp.append((variable[i]-minimum)/(maximum-minimum))

normalized = normalized_temp
# ---------- end ghpython_script_2 ----------
ghpython_script_3 = GhPythonScript(variable=panel_51)  # -> out, minimum, maximum, simplify(graft(normalized)); inputs variable: list; same code as ghpython_script_2
panel_54 = Panel(ghpython_script_2.normalized)
panel_55 = Panel(ghpython_script_3.normalized)
height_2 = Panel("""99.968295
40
35
30
80
10.674223""")
height_3 = Panel("""99.9683
40
35
30
80
10.67422""")
panel_56 = Panel([ghpython_script_2.maximum, ghpython_script_2.minimum])
ghpython_script_4 = GhPythonScript(variable=height_2)  # -> out, minimum, maximum, simplify(graft(normalized)); inputs variable: list; same code as ghpython_script_2
ghpython_script_5 = GhPythonScript(variable=height_3)  # -> out, minimum, maximum, simplify(graft(normalized)); inputs variable: list; same code as ghpython_script_2
panel_57 = Panel([ghpython_script_3.minimum, ghpython_script_3.maximum])

height_t1 = Slider(5.8, range=3.9..6)
sampler = Sampler(
    Variables=number_slider_2,
    Samples=Slider(100, range=0..1000),
    Type=Slider(0, range=0..100),
    Seed=Slider(0, range=0..100),
    Filename="FloorSamples",
    Directory="C:\Users\ja2qm\Downloads\DRKim")  # -> DesignMap, Data
height_4 = Slider(100, range=0..100)
flip = FlipMatrix(Data=sampler.DesignMap)
item = ListItem(List=flip, Index=height_4, Wrap=True)
bang_3 = ExplodeTree(Data=item)  # -> Branch0, Branch1, Branch2, Branch3, Branch4
panel_58 = Panel(bang_3.Branch2)
panel_59 = Panel(bang_3.Branch3)
panel_60 = Panel(bang_3.Branch0)
panel_61 = Panel(bang_3.Branch1)
panel_62 = Panel(bang_3.Branch4)

number_slider_4 = Slider(5, range=0..10)
number_slider_5 = Slider(5, range=0..10)
number_slider_6 = Slider(5, range=0..10)
number_slider_7 = Slider(5, range=0..10)
number_slider_8 = Slider(5, range=0..10)
crow_bp = CrowEngineBackpropagation(Cycles=1000)  # -> MeanSquareError, Network
bp_vc = BackpropagationVectorClassifier(CrowNet=crow_bp.Network, InputVector=ghpython_script_5.normalized)
data_2 = Data(bp_vc)
wallacei_x = WallaceiX(
    Genes=[number_slider_7, number_slider_8, number_slider_5, number_slider_6, number_slider_4],
    Objectives=data_2,
    allFitness="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",
    allFrontIdx="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",
    allGenomes="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",
    curFrontIdx="21|0;21|1;21|2;21|3;21|4;21|5;21|6;21|7;21|8;21|9;21|10;21|11;21|12;21|13;21|14;21|15;21|16;21|17;21|18;21|19;21|20;21|21;21|22;21|23;21|24;21|25;21|26;21|27;21|28;21|29;21|30;21|31;21|32;21|33;21|34;21|35;21|36;21|37;21|38;21|39;21|40;21|41;21|42;21|43;21|44;21|45;21|46;21|47;21|48;21|49",
    curFrontIdxSave="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",
    popGen="50,100",
    total="4703219",
    wlcDone=True)  # -> WallaceiGenomes, FitnessValues, Data, WPhenotypes

# ---- group: IVs
split_tree_2 = SplitTree(Data=ghpython_script_2.normalized, Masks=flatten("{0 to 79}"))  # -> Positive, Negative
panel_63 = Panel(split_tree_2.Negative)

# ---- group: SimulationResult
split_tree_3 = SplitTree(Data=ghpython_script_3.normalized, Masks=flatten("{0 to 79}"))  # -> Positive, Negative
panel_64 = Panel(split_tree_3.Negative)

# ----
ghpython_script_6 = GhPythonScript(normalized=split_tree_3.Negative, minimum_input=ghpython_script_3.minimum, maximum_input=ghpython_script_3.maximum)  # -> out, simplify(graft(denormalized)); inputs normalized: list
# ---------- ghpython_script_6: Python ----------
__author__ = "ja2qm"
__version__ = "2021.03.17"

import rhinoscriptsyntax as rs
import math


"""
minimum_temp = []
for i in range(len(variable)):
    minimum_temp.append(min(variable[i]))

minimum = minimum_temp
"""

minimum = minimum_input
maximum = maximum_input
#denormalized = (normalized*(maximum-minimum)+maximum)


denormalized_temp = []
for i in range(len(normalized)):
    denormalized_temp.append(normalized[i]*(maximum-minimum)+maximum)

denormalized = denormalized_temp
# ---------- end ghpython_script_6 ----------

file_path_4 = FilePath("C:\20210303_compiled\foo.xlsx")
read_excel_sheet_4 = ReadExcelSheet(Run=Toggle(True), FilePath=file_path_4, Worksheet="1", Listen=False)  # -> UserMessages, Columns, Rows
partition_list = PartitionList(List=read_excel_sheet_4.Rows, Size=9)
split_tree_4 = SplitTree(Data=partition_list, Masks=flatten("{0 to 999; 0}"))  # -> simplify(Positive), simplify(Negative)
panel_65 = Panel(split_tree_4.Positive)

unit_z_2 = UnitZ(Factor=bang_3.Branch0)
panel_66 = Panel(flip)
colibri_iterator = ColibriIterator(height=height_4, RemoteFly=False, ignoreAllWarningMsg=False)  # -> Height, Value_N, IterationGenome
panel_67 = Panel(partition_list)
graft_tree = GraftTree(Tree=split_tree_4.Negative, IncludeEmptyLists=True, IncludeNullItems=True)
graft_tree_2 = GraftTree(Tree=split_tree_4.Negative, IncludeEmptyLists=True, IncludeNullItems=True)
graft_tree_3 = GraftTree(Tree=split_tree_4.Negative, IncludeEmptyLists=True, IncludeNullItems=True)
split_tree_5 = SplitTree(Data=graft_tree, Masks=flatten("{1 to 999; 0}"))  # -> Positive, Negative
split_tree_6 = SplitTree(Data=graft_tree_2, Masks=flatten("{1 to 999; 1}"))  # -> Positive, Negative
split_tree_7 = SplitTree(Data=graft_tree_3, Masks=flatten("{1 to 999; 2}"))  # -> Positive, Negative
solar = Data(simplify(split_tree_6.Positive))
solar_2 = Data(simplify(split_tree_5.Positive))
solar_3 = Data(simplify(split_tree_7.Positive))
colibri_aggregator = ColibriAggregator(
    Folder="C:\Users\ja2qm\Downloads\DRKim\iterations\prediction",
    IterationGenomeID=colibri_iterator.IterationGenome,
    IterationPhenomeResults=colibri_parameters,
    _3DObjects=flatten(radiationanalysis.radiationMesh),
    Write=Toggle(False),
    recordingMode=3)
merge_3 = Merge(
    Data1=number_slider_8,
    Data2=number_slider_7,
    Data3=number_slider_5,
    Data4=number_slider_6,
    Data5=number_slider_4,
    Data6=Slider(5, range=0..10),
    Data7=Slider(5, range=0..10),
    Data8=Slider(5, range=0..10))  # -> simplify(graft(Result))
panel_68 = Panel(merge_3)
panel_69 = Panel(ghpython_script_6.denormalized)
ghpython_script_7 = GhPythonScript(normalized=data_2, minimum_input=ghpython_script_3.minimum, maximum_input=ghpython_script_3.maximum)  # -> out, simplify(graft(denormalized)); inputs normalized: list
# ---------- ghpython_script_7: Python ----------
__author__ = "ja2qm"
__version__ = "2021.03.17"

import rhinoscriptsyntax as rs
import math


"""
minimum_temp = []
for i in range(len(variable)):
    minimum_temp.append(min(variable[i]))

minimum = minimum_temp
"""

minimum = minimum_input
maximum = maximum_input
#denormalized = (normalized*(maximum-minimum)+maximum)


denormalized_temp = []
for i in range(len(normalized)):
    denormalized_temp.append((normalized[i]*(maximum-minimum)+maximum))

denormalized = denormalized_temp
# ---------- end ghpython_script_7 ----------
denormalization = Expression(normalized=data_2, low="388.497375", high="1396.461319", Expression="(normalized*(high-low)+low)")  # -> simplify(Result)
denormalization_2 = Expression(normalized=data_2, low="10", high="90", Expression="(normalized*(high-low)+low)")  # -> simplify(Result)
panel_70 = Panel(denormalization)
panel_71 = Panel(denormalization_2)

panel_72 = Panel(solar_2)

data_3 = Data("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")

# ---- group: read file
python = GhPythonScript(json_str=data_3)  # -> out, Index, dataString
# ---------- python: Python ----------
import json

json_data = json.loads(json_str)


index = []
for item in json_data:
    print item
    index.append(item)

Index = index

dataString = json_str
# ---------- end python ----------

# ----
python_2 = GhPythonScript(dataString=python.dataString, indexList=python.Index, index=Slider(30, range=0..100))  # -> out, Lat, Lon; inputs indexList: list, index: Int32
# ---------- python_2: Python ----------
__author__ = "NJ9"
__version__ = "2018.10.03"

import json
d = json.loads(dataString)

key = indexList[index] 
print key

LatList = []
LonList = []

for i in d[key]:
    LatList.append(i["lat"])
    LonList.append(i["long"])

Lat = LatList
Lon = LonList
# ---------- end python_2 ----------
panel_73 = Panel(python.Index)
panel_74 = Panel(python_2.out)
python_3 = GhPythonScript(Lat=python_2.Lat, Lon=python_2.Lon)  # -> out, Pts; inputs Lat: list, Lon: list
# ---------- python_3: Python ----------
__author__ = "NJ9"
__version__ = "2018.10.02"

import rhinoscriptsyntax as rs
import math

def MercatorProjection( latitude, longitude):
    mapWidth = 30559983.333
    mapHeight = 446

    x = (longitude + 180) * (mapWidth / 360);

    latRad = latitude * math.pi / 180;

    mercN = math.log(math.tan((math.pi / 4) + (latRad / 2)));
    y = (mapHeight / 2) - (mapWidth * mercN / (2 * math.pi)) * -1;
    outNum = [x,y]
    return outNum;

pts = []
for i in range(len(Lat)):
    pos =  MercatorProjection( Lat[i] , Lon[i] )
    
    p = rs.AddPoint( pos[0], pos[1]  , 0 )
    pts.append(p)

Pts = pts
# ---------- end python_3 ----------
pt = Point(python_3.Pts)

python_4 = GhPythonScript(Keyword="car", Index=python.Index)  # -> out, index; inputs Index: list
# ---------- python_4: Python ----------
__author__ = "NJ9"
__version__ = "2018.10.03"

indexNumList = []
num = 0
for i in Index:
#    print i
    if Keyword in i:
        print "the index of " + str(i) + " is " + str(num)
        indexNumList.append(num);
    num = num+1

index = indexNumList
# ---------- end python_4 ----------
# ReadingJSON
panel_75 = Panel(python_4.index)
panel_76 = Panel(python_4.out)

# ----
# File paths to data from the NCDC
# (request data from https://gis.ncdc.noaa.gov/maps/ncei/cdo/hourly)
# CreatingWeatherFile
panel_77 = Panel("C:\Users\ja2qm\Downloads\07156099999.csv")
paris_weather_data = FilePath("C:\Users\chris\Documents\GitHub\grasshopper\dragonfly-grasshopper\samples\alt_weather_data\07156099999.csv")
panel_78 = Panel(paris_weather_data)
importnoaa = DFImportNOAAFile(noaa_file=panel_77, time_zone="1", run=Toggle(True))  # -> location, dry_bulb_temp, dew_point_temp, wind_speed, wind_direction, total_sky_cover, atmos_pressure, visibility, ceiling_height, model_year; plug-in component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

tostep = LBConvertToTimestep(data=importnoaa.atmos_pressure)  # -> data; plug-in component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
tostep_2 = LBConvertToTimestep(data=importnoaa.ceiling_height)  # -> data; plug-in component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
tostep_3 = LBConvertToTimestep(data=importnoaa.model_year)  # -> data; plug-in component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
tostep_4 = LBConvertToTimestep(data=importnoaa.visibility)  # -> data; plug-in component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
tostep_5 = LBConvertToTimestep(data=importnoaa.total_sky_cover)  # -> data; plug-in component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
tostep_6 = LBConvertToTimestep(data=importnoaa.dew_point_temp)  # -> data; plug-in component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
tostep_7 = LBConvertToTimestep(data=importnoaa.dry_bulb_temp)  # -> data; plug-in component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
tostep_8 = LBConvertToTimestep(data=importnoaa.wind_speed)  # -> data; plug-in component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
tostep_9 = LBConvertToTimestep(data=importnoaa.wind_direction)  # -> data; plug-in component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

relhumid = LBRelativeHumidityFromDewPoint(dry_bulb=tostep_7, dew_point=tostep_6)  # -> rel_humid; plug-in component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
zhang_huang = HBWeaFromZhangHuang(
    location=importnoaa.location,
    cloud_cover=tostep_5,
    rel_humidity=relhumid,
    dry_bulb_temp=tostep_7,
    wind_speed=tostep_8,
    atmos_pressure=tostep)  # -> wea; plug-in component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
decnstrwea = HBDeconstructWea(wea=zhang_huang)  # -> dir, diff, glob; plug-in component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

data_4 = Data(tostep_7)
data_5 = Data(importnoaa.dry_bulb_temp)
hourlyplot_2 = LBHourlyPlot(data=[data_5, data_4])  # -> report, mesh, legend, borders, labels, title; plug-in component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
xdata = LBDeconstructData(data=data_4)  # -> header, values; plug-in component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
dry_bulb_temperature_c = Panel(xdata.values)

lumeff = DFLuminousEfficacy(wea=zhang_huang, dew_point=tostep_6)  # -> dir_ill, diff_ill, glob_ill; plug-in component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
horizinfr = DFHorizontalInfrared(sky_cover=tostep_5, dry_bulb=tostep_7, dew_point=tostep_6)  # -> horiz_infrared; plug-in component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
createepw = DFCreateEPW(
    location=importnoaa.location,
    dry_bulb_temp=tostep_7,
    dew_point_temp=tostep_6,
    wind_speed=tostep_8,
    wind_direction=tostep_9,
    direct_normal_rad=decnstrwea.dir,
    diffuse_horiz_rad=decnstrwea.diff,
    horiz_infrared_rad=horizinfr,
    direct_normal_ill=lumeff.dir_ill,
    diffuse_horiz_ill=lumeff.diff_ill,
    total_sky_cover=tostep_5,
    atmos_pressure=tostep,
    visibility=tostep_4,
    ceiling_height=tostep_2,
    model_year=tostep_3,
    run=Toggle(True))  # -> report, epw_obj; plug-in component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
writeepw = DFWriteEPW(epw_obj=createepw.epw_obj, file_name="Paris_2003_HeatWave", run=Toggle(True))  # -> report, epw_file; plug-in component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
panel_79 = Panel(writeepw.epw_file)

number_slider_9 = Slider(0.01, range=0..0.01)
number_slider_10 = Slider(5, range=0..100)
number_slider_11 = Slider(2490, range=1000..2500)
backprop = CrowNetConstructorBackpropagationNetwork(LayerStructure=Slider(0, range=0..100), NeuronCount=number_slider_10, LearningRate=number_slider_3)
crow_bp_2 = CrowEngineBackpropagation(
    Cycles=number_slider_11,
    CrowNetBackpropagation=backprop,
    TrainingInputVectors=split_tree_2.Positive,
    TrainingOutputVectors=split_tree_3.Positive)  # -> MeanSquareError, Network
mse = Data(flatten(crow_bp_2.MeanSquareError))

panel_80 = Panel(mse)
backpropagation_vector_classifier = BackpropagationVectorClassifier(CrowNet=crow_bp_2.Network, InputVector=split_tree_2.Negative)
panel_81 = Panel(backpropagation_vector_classifier)
ghpython_script_8 = GhPythonScript(
    normalized=backpropagation_vector_classifier,
    minimum_input=ghpython_script_3.minimum,
    maximum_input=ghpython_script_3.maximum)  # -> out, simplify(graft(denormalized)); inputs normalized: list; same code as ghpython_script_6
panel_82 = Panel(ghpython_script_8.denormalized)
ghpython_script_9 = GhPythonScript(x=flatten(panel_64), y=flatten(panel_81))  # -> out, min_x, max_x, mean_x, min_y, max_y, mean_y, variances_x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; inputs x: list, y: list
# ---------- ghpython_script_9: Python ----------
__author__ = "ja2qm"
__version__ = "2021.03.17"

import rhinoscriptsyntax as rs

import math

min_x = min(x)
max_x = max(x)

sum_x = sum(x)
length_x = len(x)
mean_x = sum_x/length_x

min_y = min(y)
max_y = max(y)


sum_y = sum(y)
length_y = len(y)
mean_y = sum_y/length_y


variancesx = []
for i in range(len(x)):
    variancesx.append(x[i]-mean_x)

variances_x = variancesx


variancesy = []
for i in range(len(y)):
    variancesy.append(y[i]-mean_y)

variances_y = variancesy



variancesx2 = []
for i in range(len(variances_x)):
    variancesx2.append(variances_x[i]**2)

variances_x2 = sum(variancesx2)


variancesy2 = []
for i in range(len(variances_y)):
    variancesy2.append(variances_y[i]**2)

variances_y2 = sum(variancesy2)




nominator_a = []
for i in range(len(variances_x)):
    nominator_a.append(variances_x[i] * variances_y[i])

nominator = sum(nominator_a)


"""
denominator_a = []
for i in range(len(variances_x)):
    denominator_a.append(math.sqrt((variances_x2[i]) * (variances_y2[i])))

denominator = sum(denominator_a)
"""

denominator = math.sqrt(variances_x2 *variances_y2)


#Correlation Coefficient = Σ [(X – Xm) * (Y – Ym)] / √ [Σ (X – Xm)2 * Σ (Y – Ym)2]
#nominator = variances_x * variances_y
#denominator = sqrt(variances_x2) * sqrt(variances_y2)
r = (nominator/denominator)
# ---------- end ghpython_script_9 ----------
negative = Negative(Value=ghpython_script_9.r)
correlation = Correlation(XData=panel_64, YData=panel_81)  # -> PearsonCoef, SpearmanCoef, RSquared, PValue, SummaryOfPerson
data_recorder = DataRecorder(mse, DataLimit=-10, RecordData=True)
panel_83 = Panel(correlation.SummaryOfPerson)
panel_84 = Panel(data_recorder)

# ---- group: r
data_6 = Data(flatten(negative))

# ----
r = Panel(data_6)
data_recorder_2 = DataRecorder(data_6, DataLimit=-10, RecordData=True)
panel_85 = Panel(data_recorder_2)

wallacei_x_2 = WallaceiX(
    Genes=[number_slider_3, number_slider_10, number_slider_11],
    Objectives=[mse, data_6],
    allFitness="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",
    allFrontIdx="15|9;26|9;36|7;48|8;52|7;57|8;83|8;90|7;90|8;91|9;98|10",
    allGenomes="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",
    curFrontIdx="99|0;99|1;99|2;99|3;99|4;99|5;99|6;99|7;99|8;99|9;99|10",
    curFrontIdxSave="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",
    popGen="50,100",
    total="2365844",
    wlcDone=True)  # -> WallaceiGenomes, FitnessValues, Data, WPhenotypes

# ----
# Deconstruct Program
panel_86 = Panel("2013::MediumOffice::ClosedOffice")

deconstrprogram = HBDeconstructProgramType(program=panel_86)  # -> people, lighting, electric_equip, gas_equip, hot_water, infiltration, ventilation, setpoint; plug-in component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

decnstrlighting = HBDeconstructLighting(lighting=deconstrprogram.lighting)  # -> name, watts_per_area, schedule, radiant_fract, visible_fract, return_fract, baseline; plug-in component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
decnstrsetpoint = HBDeconstructSetpoint(setpoint=deconstrprogram.setpoint)  # -> name, heating_sch, cooling_sch, humid_setpt, dehumid_setpt; plug-in component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
decnstrinfiltration = HBDeconstructInfiltration(infil=deconstrprogram.infiltration)  # -> name, flow_per_ext_area, schedule; plug-in component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
decnstrequipment = HBDeconstructEquipment(equip=deconstrprogram.electric_equip)  # -> name, watts_per_area, schedule, radiant_fract, latent_fract, lost_fract, is_gas; plug-in component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
decnstrventilation = HBDeconstructVentilation(vent=deconstrprogram.ventilation)  # -> name, flow_per_person, flow_per_area, flow_per_zone, ach, schedule; plug-in component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
decnstrpeople = HBDeconstructPeople(people=deconstrprogram.people)  # -> name, ppl_per_area, occupancy_sch, activity_sch; plug-in component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
deconstrsch_2 = HBDeconstructSchedule(schedule=decnstrpeople.occupancy_sch)  # -> day_names, day_data, type_limit; plug-in component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
panel_87 = Panel(decnstrpeople.ppl_per_area)
panel_88 = Panel(decnstrpeople.name)
xdata_2 = LBDeconstructData(data=deconstrsch_2.day_data)  # -> header, values; plug-in component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
# ShoeboxEnergyModel
panel_89 = Panel(xdata_2.values)

# ==== cluster Cluster
division = Division(A="1", B="2190")
neg = Negative(Value=division)
dup = DuplicateData(Data="0", Number="2190", Order=True)
dup_2 = DuplicateData(Data="1", Number="2190", Order=True)
series = Series(Start="1", Step=neg, Count="2190")
series_2 = Series(Start=0, Step=division, Count="2190")
S = ClusterOutput(series)
S_2 = ClusterOutput(series_2)
D = ClusterOutput(dup)
D_2 = ClusterOutput(dup_2)
