# Grasshopper definition 20230126_DigitalTwinForCo2.gh (Grasshopper 1.0.7)
# plug-ins: Colibri, TT Toolbox, Speckle 2

worksheet = Slider(1, range=1..2)
file_path = FilePath("H:\MIZZOU\_MotherFolderAmanWorks\Research With Dr Jong Bum\_2022-2023_AT&T_DigitalTwin\_WorkUpdates_DigitalTwinResearch_AT&T\_Spring23Works\20230123_DigitalTwinScript\digitaltwin744.xlsx")
read_excel_sheet = ReadExcelSheet(Run=Toggle(True), FilePath=file_path, Worksheet=worksheet, Listen=False)  # -> UserMessages, Columns, Rows
bang = ExplodeTree(Data=read_excel_sheet.Columns)  # -> Branch0, Branch1, Branch2, Branch3
panel = Panel(bang.Branch3)
id = Slider(743, range=0..743)
item = ListItem(List=[bang.Branch1, bang.Branch2, bang.Branch3], Index=id, Wrap=True)
bang_2 = ExplodeTree(Data=item)  # -> flatten(Branch0), flatten(Branch1), flatten(Branch2)
equipmentloadperarea = Number(bang_2.Branch2)
lightingperarea = Number(bang_2.Branch1)
peopleperarea = Number(bang_2.Branch0)
panel_2 = Panel(equipmentloadperarea)

panel_3 = Panel(file_path)
construct_domain = ConstructDomain(DomainStart="0", DomainEnd="743")
iteration_selection = IterationSelection(Domain=construct_domain)
iterator = ColibriIterator(Input=id, Selection=iteration_selection, RemoteFly=False, ignoreAllWarningMsg=False)  # -> Value, IterationGenome

panel_4 = Panel(item)
panel_5 = Panel("SchoolSecondary HTGSETP_SCH_YES_OPTIMUM")

# ----
# Create Weekly Schedule
dayschedule = HBDaySchedule(
    Decimals=1,
    Maximum=1,
    Minimum=0,
    Value=[0, 0, 0, 0, 0, 0, 0, 0, 0, 0.1, 0.3, 0.3, 0.3, 0.3, 0.3, 0.3, 0.2, 0.1, 0, 0, 0, 0, 0, 0])
dayschedule_2 = HBDaySchedule(
    Decimals=1,
    Maximum=1,
    Minimum=0,
    Value=[0, 0, 0, 0, 0, 0, 0, 0.1, 0.8, 1, 1, 1, 1, 1, 1, 1, 1, 0.8, 0.3, 0.3, 0.1, 0, 0, 0])
weeklyschedule = HBWeeklySchedule(
    sun="0",
    mon=dayschedule_2,
    tue=dayschedule_2,
    wed=dayschedule_2,
    thu=dayschedule_2,
    fri=dayschedule_2,
    sat=dayschedule,
    name="Office Occ Normal")  # -> report, schedule, idf_year, idf_week, idf_days; plug-in component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

# ----
# CreatingBuildingSchedule
# (We can collect sensor data as Inputs)
# Create Constant (Repeating Daily) Schedule
dayschedule_3 = HBDaySchedule(
    Decimals=1,
    Maximum=1,
    Minimum=0,
    Value=[0, 0, 0, 0, 0, 0, 0, 0.1, 0.8, 1, 1, 1, 1, 1, 1, 1, 1, 0.8, 0.3, 0.3, 0.1, 0, 0, 0])
constantschedule = HBConstantSchedule(values=dayschedule_3, name="Office Occ Deadline")  # -> report, schedule, idf_text; plug-in component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
genepooltodaysch = HBGenePoolToDaySchedule(gene_pool=dayschedule_3, run=Toggle(False))  # -> report; plug-in component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

# ----
# CreatingBuildingProgram
# (We can collect sensor data as Inputs)
panel_7 = Panel("University Setpoint")
deconstrsch = HBDeconstructSchedule(schedule="SchoolSecondary CLGSETP_SCH_NO_SETBACK")  # -> day_names, day_data, type_limit; plug-in component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
panel_8 = Panel(deconstrsch.type_limit)

# ----
# Create Seasonal Schedule
panel_9 = Panel("6")
analysisperiod = LBAnalysisPeriod(start_month=panel_9, start_day=1, start_hour=0, end_month=panel_9)  # -> period, hoys, dates; plug-in component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
seasonalschedule = HBSeasonalSchedule(
    base_schedule=weeklyschedule.schedule,
    season_scheds=constantschedule.schedule,
    analysis_periods=analysisperiod.period,
    name="Office Occ w/ Deadline")  # -> report, schedule, idf_year, idf_week, idf_days; plug-in component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
panel_10 = Panel(seasonalschedule.schedule)

# ----
# We'll create custom schedule for setpoint
# Create Fixed Interval Schedule
cluster = Cluster()  # -> D, S_2, D_2, S
data = Data([cluster.D, cluster.S_2, cluster.D_2, cluster.S])
fixedintervalschedule = HBFixedIntervalSchedule(values=data, name="Gradual Transparency Shift")  # -> report, schedule; plug-in component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
panel_11 = Panel(fixedintervalschedule.schedule)
panel_12 = Panel(data)

number_slider = Slider(0.5, range=0..1)

watts_per_area = Slider(5, range=1..10)
ppl_per_area = Slider(1, range=1..10)
watts_per_area_2 = Slider(10, range=1..10)

# ----
# Browse ProgramTypes
bldgvintages = HBBuildingVintages({"ASHRAE 90.1 2013  |  IECC 2015": "2013", "ASHRAE 90.1 2010  |  IECC 2012": "2010", "ASHRAE 90.1 2007  |  IECC 2009": "2007", "ASHRAE 90.1 2004  |  IECC 2006": "2004", "1980-2004 (CBECS)": "1980_2004", "Pre-1980 (CBECS)": "pre_1980"}, selected="ASHRAE 90.1 2013  |  IECC 2015")
bldgprograms = HBBuildingPrograms({"LargeOffice", "MediumOffice", "SmallOffice", "MidriseApartment", "HighriseApartment", "Retail", "StripMall", "PrimarySchool", "SecondarySchool", "SmallHotel", "LargeHotel", "Hospital", "Outpatient", "Laboratory", "Warehouse", "SuperMarket", "FullServiceRestaurant", "QuickServiceRestaurant", "Courthouse", "LargeDataCenterHighITE", "LargeDataCenterLowITE", "SmallDataCenterHighITE", "SmallDataCenterLowITE"}, selected="LargeOffice")
searchprog = HBSearchPrograms(bldg_prog=bldgprograms, vintage=bldgvintages)  # -> room_prog; plug-in component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
panel_13 = Panel(searchprog)

# ----
# Blend ProgramTypes
panel_14 = Panel("""2013::LargeOffice::ClosedOffice
2013::LargeOffice::Conference
2013::LargeOffice::Corridor
2013::LargeOffice::IT_Room
2013::LargeOffice::OpenOffice
2013::LargeOffice::PrintRoom
2013::LargeOffice::Restroom
2013::LargeOffice::Storage""")
panel_15 = Panel("""0.05
0.15
0.2
0.05
0.4
0.05
0.05
0.05""")
blendprograms = HBBlendProgramTypes(name="Full Building Office", programs=panel_14, ratios=panel_15)  # -> program; plug-in component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

# ----
# Testbed Schedule Based on Sensor Data
panel_16 = Panel("SchoolSecondary HTGSETP_SCH_YES_OPTIMUM")

division = Division(A=peopleperarea, B=100)

# ----
# Deconstruct Schedues
panel_17 = Panel("Monday")
schtodata = HBScheduleToData(schedule=weeklyschedule.schedule, week_start_day=panel_17, holidays="1 Jan")  # -> data; plug-in component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
deconstrsch_2 = HBDeconstructSchedule(schedule=weeklyschedule.schedule)  # -> day_names, day_data, type_limit; plug-in component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

# ----
# Create ScheduleTypeLimits
panel_18 = Panel("Fan Speed")
typelimit = HBTypeLimit(name=panel_18, low_limit="0", unit_type="Velocity")  # -> report, type_limit; plug-in component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
panel_19 = Panel(typelimit.type_limit)

# ----
# Search Schedule Library
searchschs = HBSearchSchedules()  # -> schedules, type_limits; plug-in component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
panel_20 = Panel(searchschs.schedules)

setpoint = HBSetpoint(name="University Setpoint", heating_sch=panel_16, cooling_sch="SchoolSecondary CLGSETP_SCH_NO_SETBACK")  # -> setpoint; plug-in component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
lighting = HBLighting(name="University Lighting", watts_per_area=lightingperarea, schedule="SchoolPrimary BLDG_LIGHT_GYM_SCH", baseline="10")  # -> lighting; plug-in component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
ventilation = HBVentilation(name="University Ventilation", flow_per_person="0.01")  # -> vent; plug-in component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
people = HBPeople(name="University People", ppl_per_area=division, occupancy_sch="PrimarySchool Bldg Occ")  # -> people; plug-in component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
infiltration = HBInfiltration(name="University Infiltration", flow_per_ext_area="0.0003")  # -> infil; plug-in component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
equipment = HBEquipment(name="University Equipment", watts_per_area=equipmentloadperarea, schedule="SchoolPrimary BLDG_EQUIP_SCH_2010")  # -> equip; plug-in component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

# ----
# Assign Schedues
applyroomsch = HBApplyRoomSchedules()  # -> report, mod_obj; plug-in component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
# CreatingWeatherFile
applyshadesch = HBApplyShadeSchedule()  # -> hb_objs; plug-in component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

programtype = HBProgramType(
    name="Stanley Testbed",
    people=people,
    lighting=lighting,
    electric_equip=equipment,
    infiltration=infiltration,
    ventilation=ventilation,
    setpoint=setpoint)  # -> program; plug-in component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

# ---- group: Dynamically Chage Glazing Ratio
number_slider_2 = Slider(3, range=1..9, expression="x * 0.1")

# ----
# Create Honeybee Model
panel_21 = Panel("outdoors")
geo = Geometry(<brep referenced from the Rhino model>)
geo_2 = Geometry(<brep referenced from the Rhino model>)
face = HBFace(geo=geo, bc=panel_21)  # -> report, faces; plug-in component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
face_2 = HBFace(geo=geo_2, bc="adiabatic")  # -> report, faces; plug-in component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
panel_22 = Panel("2013::LargeOffice::OpenOffice")
aperturesbyratio = HBAperturesByRatio(hb_objs=flatten(face.faces), ratio=number_slider_2)  # -> report, hb_objs; plug-in component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
all_air = HBAllAirHVACTemplates({"VAV chiller with gas boiler reheat": "VAV_Chiller_Boiler", "VAV chiller with central air source heat pump reheat": "VAV_Chiller_ASHP", "VAV chiller with district hot water reheat": "VAV_Chiller_DHW", "VAV chiller with PFP boxes": "VAV_Chiller_PFP", "VAV chiller with gas coil reheat": "VAV_Chiller_GasCoil", "VAV air-cooled chiller with gas boiler reheat": "VAV_ACChiller_Boiler", "VAV air-cooled chiller with central air source heat pump reheat": "VAV_ACChiller_ASHP", "VAV air-cooled chiller with district hot water reheat": "VAV_ACChiller_DHW", "VAV air-cooled chiller with PFP boxes": "VAV_ACChiller_PFP", "VAV air-cooled chiller with gas coil reheat": "VAV_ACChiller_GasCoil"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}, selected="VAV chiller with gas boiler reheat")
room = HBRoom(
    faces=flatten([face_2.faces, aperturesbyratio.hb_objs]),
    name="Office Shoe Box",
    constr_set="2013::ClimateZone5::SteelFramed",
    program=programtype,
    conditioned=True)  # -> report, room; plug-in component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
concat = Concatenate(FragmentA="ShoeBox", FragmentB=number_slider_2)
allairhvac = HBAllAirHVAC(rooms=flatten(room.room), system_type=all_air, name="VAV System", economizer="DifferentialDryBulb")  # -> report, rooms; plug-in component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
daylightcontrol = HBApplyDaylightControl(rooms=flatten(allairhvac.rooms))  # -> report, rooms; plug-in component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
model = HBModel(rooms=flatten(daylightcontrol.rooms), name=concat)  # -> report, model; plug-in component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

# ----
# Request Outputs
toggle = BooleanToggle(True)
simoutput = HBSimulationOutput(zone_energy_use=toggle, hvac_energy_use=toggle)  # -> report, sim_output; plug-in component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
simpar = HBSimulationParameter(output=simoutput.sim_output, timestep=6)  # -> sim_par; plug-in component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

# ----
# Download EPW File
panel_23 = Panel("https://energyplus-weather.s3.amazonaws.com/north_and_central_america_wmo_region_4/USA/MO/USA_MO_Columbia.Rgnl.AP.724450_TMY3/USA_MO_Columbia.Rgnl.AP.724450_TMY3.zip")
downloadepw = LBDownloadWeather(weather_URL=panel_23)  # -> epw_file, stat_file, ddy_file; plug-in component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

# ----
# EnergyPlus documentation
# https://energyplus.net/assets/nrel_custom/pdfs/pdfs_v9.6.0/InputOutputReference.pdf
toggle_2 = BooleanToggle(False)
modeltoosm = HBModelToOSM(model=model.model, epw_file=downloadepw.epw_file, sim_par=simpar, write=toggle_2, run=toggle_2)  # -> report, jsons, osw, osm, idf, sql, zsz, rdd, html; plug-in component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

# ----
# Compute EUI
eui = HBEndUseIntensity(sql=modeltoosm.sql)  # -> eui, eui_end_use, end_uses, gross_floor; plug-in component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
eui_kwh_m2 = Panel(eui.eui)
panel_24 = Panel(eui.eui_end_use)
panel_25 = Panel(eui.end_uses)

# ----
# Visualize Results
roomenergyresult = HBReadRoomEnergyResult(sql=modeltoosm.sql)  # -> cooling, heating, lighting, electric_equip, gas_equip, process, hot_water, fan_electric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; plug-in component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
hourlyplot = LBHourlyPlot(data=[roomenergyresult.cooling, roomenergyresult.heating])  # -> report, mesh, legend, borders, labels, title; plug-in component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

# ---- group: Carbon Factor
panel_26 = Panel("0.69")
multiplication = Multiplication(A=eui_kwh_m2, B=panel_26)

# ---- group: Operational Carbon Per Hour ( (lb CO2/m2)
panel_27 = Panel("8760")
division_2 = Division(A=multiplication, B=panel_27)

# ---- group: Operational Carbon per Hour (lb CO2)
geo_3 = Geometry(<brep referenced from the Rhino model>)
area = Area(Geometry=geo_3)  # -> Area, Centroid
multiplication_2 = Multiplication(A=division_2, B=area.Area)

# ----
python = GhPythonScript(EUI=eui_kwh_m2, carbon_factor=panel_26, hours=panel_27, area=area.Area)  # -> out, carbon_per_anum, carbon_per_hour_sqm, carbon_per_hour_total, operational_carbon
# ---------- python: Python ----------
__author__ = "ja2qm"
__version__ = "2023.01.26"

import rhinoscriptsyntax as rs


carbon_per_anum = EUI * carbon_factor
carbon_per_hour_sqm = carbon_per_anum/hours
carbon_per_hour_total = carbon_per_hour_sqm * area

if carbon_per_hour_total > 1.5:
    operational_carbon = carbon_per_hour_total
    
else:
    operational_carbon = "We have very low amount of carbon emissions happening in steelcase studio...therefore, negligible"
# ---------- end python ----------
panel_28 = Panel(python.operational_carbon)
operationalcarbon_lb_co2_per_hour = Panel(multiplication_2)
parameters = ColibriParameters(OperationalCarbon=flatten(operationalcarbon_lb_co2_per_hour))

panel_29 = Panel("H:\MIZZOU\_MotherFolderAmanWorks\Research With Dr Jong Bum\_2022-2023_AT&T_DigitalTwin\_WorkUpdates_DigitalTwinResearch_AT&T\_Spring23Works\20230123_DigitalTwinScript\DigitalTwin0-743_Final")
image_setting = ImageSetting(ImageSaveAsName="defaultName", RhinoViewNames="OverlandPark", Width="2000", Height="1200")
colibri_aggregator = ColibriAggregator(
    Folder=panel_29,
    IterationGenomeID=iterator.IterationGenome,
    IterationPhenomeResults=parameters,
    ImgSetting=image_setting,
    Write=Toggle(False),
    recordingMode=3)

# ----
# Assign Programs/Loads
applyprogram = HBApplyProgramType()  # -> report, rooms; plug-in component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
applyloadvals = HBApplyLoadValues()  # -> report, mod_obj; plug-in component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
applysetpointvals = HBApplySetpointValues()  # -> report, mod_obj; plug-in component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
absoluteloadvals = HBApplyAboluteLoadValues()  # -> report, rooms; plug-in component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

# ----
# Deconstruct Program
panel_30 = Panel("2013::LargeOffice::Classroom")

deconstrprogram = HBDeconstructProgramType(program=panel_30)  # -> people, lighting, electric_equip, gas_equip, hot_water, infiltration, ventilation, setpoint; plug-in component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

decnstrlighting = HBDeconstructLighting(lighting=deconstrprogram.lighting)  # -> name, watts_per_area, schedule, radiant_fract, visible_fract, return_fract, baseline; plug-in component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
decnstrsetpoint = HBDeconstructSetpoint(setpoint=deconstrprogram.setpoint)  # -> name, heating_sch, cooling_sch, humid_setpt, dehumid_setpt; plug-in component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
decnstrinfiltration = HBDeconstructInfiltration(infil=deconstrprogram.infiltration)  # -> name, flow_per_ext_area, schedule; plug-in component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
decnstrequipment = HBDeconstructEquipment(equip=deconstrprogram.electric_equip)  # -> name, watts_per_area, schedule, radiant_fract, latent_fract, lost_fract, is_gas; plug-in component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
decnstrventilation = HBDeconstructVentilation(vent=deconstrprogram.ventilation)  # -> name, flow_per_person, flow_per_area, flow_per_zone, ach, schedule; plug-in component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
decnstrpeople = HBDeconstructPeople(people=deconstrprogram.people)  # -> name, ppl_per_area, occupancy_sch, activity_sch; plug-in component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
deconstrsch_3 = HBDeconstructSchedule(schedule=decnstrpeople.occupancy_sch)  # -> day_names, day_data, type_limit; plug-in component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
panel_31 = Panel(decnstrpeople.ppl_per_area)
panel_32 = Panel(decnstrpeople.name)
xdata = LBDeconstructData(data=deconstrsch_3.day_data)  # -> header, values; plug-in component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
panel_33 = Panel(xdata.values)

deconstrsch_4 = HBDeconstructSchedule(schedule=decnstrequipment.schedule)  # -> day_names, day_data, type_limit; plug-in component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
xdata_2 = LBDeconstructData(data=deconstrsch_4.day_data)  # -> header, values; plug-in component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
panel_34 = Panel(xdata_2.values)
interp = InterpolateData(Data=xdata.values, Parameter=xdata_2.values, Interpolation=2)
panel_35 = Panel(interp)

# ----
# File paths to data from the NCDC
# (request data from https://gis.ncdc.noaa.gov/maps/ncei/cdo/hourly)
panel_36 = Panel("C:\Users\ja2qm\Downloads\07156099999.csv")
paris_weather_data = FilePath("C:\Users\chris\Documents\GitHub\grasshopper\dragonfly-grasshopper\samples\alt_weather_data\07156099999.csv")
panel_37 = Panel(paris_weather_data)
importnoaa = DFImportNOAAFile(noaa_file=panel_36, time_zone="1", run=Toggle(True))  # -> location, dry_bulb_temp, dew_point_temp, wind_speed, wind_direction, total_sky_cover, atmos_pressure, visibility, ceiling_height, model_year; plug-in component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

tostep = LBConvertToTimestep(data=importnoaa.atmos_pressure)  # -> data; plug-in component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
tostep_2 = LBConvertToTimestep(data=importnoaa.ceiling_height)  # -> data; plug-in component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
tostep_3 = LBConvertToTimestep(data=importnoaa.model_year)  # -> data; plug-in component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
tostep_4 = LBConvertToTimestep(data=importnoaa.visibility)  # -> data; plug-in component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
tostep_5 = LBConvertToTimestep(data=importnoaa.total_sky_cover)  # -> data; plug-in component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
tostep_6 = LBConvertToTimestep(data=importnoaa.dew_point_temp)  # -> data; plug-in component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
tostep_7 = LBConvertToTimestep(data=importnoaa.dry_bulb_temp)  # -> data; plug-in component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
tostep_8 = LBConvertToTimestep(data=importnoaa.wind_speed)  # -> data; plug-in component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
tostep_9 = LBConvertToTimestep(data=importnoaa.wind_direction)  # -> data; plug-in component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

relhumid = LBRelativeHumidityFromDewPoint(dry_bulb=tostep_7, dew_point=tostep_6)  # -> rel_humid; plug-in component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
zhang_huang = HBWeaFromZhangHuang(
    location=importnoaa.location,
    cloud_cover=tostep_5,
    rel_humidity=relhumid,
    dry_bulb_temp=tostep_7,
    wind_speed=tostep_8,
    atmos_pressure=tostep)  # -> wea; plug-in component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
decnstrwea = HBDeconstructWea(wea=zhang_huang)  # -> dir, diff, glob; plug-in component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

data_2 = Data(tostep_7)
data_3 = Data(importnoaa.dry_bulb_temp)
hourlyplot_2 = LBHourlyPlot(data=[data_3, data_2])  # -> report, mesh, legend, borders, labels, title; plug-in component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
xdata_3 = LBDeconstructData(data=data_2)  # -> header, values; plug-in component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
dry_bulb_temperature_c = Panel(xdata_3.values)

lumeff = DFLuminousEfficacy(wea=zhang_huang, dew_point=tostep_6)  # -> dir_ill, diff_ill, glob_ill; plug-in component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
horizinfr = DFHorizontalInfrared(sky_cover=tostep_5, dry_bulb=tostep_7, dew_point=tostep_6)  # -> horiz_infrared; plug-in component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
createepw = DFCreateEPW(
    location=importnoaa.location,
    dry_bulb_temp=tostep_7,
    dew_point_temp=tostep_6,
    wind_speed=tostep_8,
    wind_direction=tostep_9,
    direct_normal_rad=decnstrwea.dir,
    diffuse_horiz_rad=decnstrwea.diff,
    horiz_infrared_rad=horizinfr,
    direct_normal_ill=lumeff.dir_ill,
    diffuse_horiz_ill=lumeff.diff_ill,
    total_sky_cover=tostep_5,
    atmos_pressure=tostep,
    visibility=tostep_4,
    ceiling_height=tostep_2,
    model_year=tostep_3,
    run=Toggle(True))  # -> report, epw_obj; plug-in component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
writeepw = DFWriteEPW(epw_obj=createepw.epw_obj, file_name="StanleyWeatherFile", run=Toggle(True))  # -> report, epw_file; plug-in component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
panel_38 = Panel(writeepw.epw_file)

# ==== cluster Cluster
division = Division(A="1", B="2190")
neg = Negative(Value=division)
dup = DuplicateData(Data="0", Number="2190", Order=True)
dup_2 = DuplicateData(Data="1", Number="2190", Order=True)
series = Series(Start="1", Step=neg, Count="2190")
series_2 = Series(Start=0, Step=division, Count="2190")
S = ClusterOutput(series)
S_2 = ClusterOutput(series_2)
D = ClusterOutput(dup)
D_2 = ClusterOutput(dup_2)
