# Grasshopper definition CO2 emission analysis script draft.gh (Grasshopper 1.0.7)
# plug-ins: ClimateStudioGH

list = ValueList({"HVAC Standard [Electric HP COP3,3]": "3,3,None,NoEconomizer,Standard", "HVAC Green [Electric HP COP4,6 HRec]": "4,6,Enthalpy,DifferentialDryBulb,Green"}, selected="HVAC Green [Electric HP COP4,6 HRec]")
elec_cost_kwh = Panel("0.08")
electricity_emission_factor_co2_kg_kwh = Panel("0.676")
list_2 = ValueList({"Residential", "Kitchen", "Office", "MeetingRoom", "HotelRoom", "ClassRoom", "Library", "LectureHall", "SuperMarket", "Shopping", "ScienceLab"}, selected="Office")
list_3 = ValueList({"Columbia, MO": "USA_MO_Columbia"}, selected="Columbia, MO")
list_4 = ValueList({"No Dimming": "Off", "Dimming": "Continuous"}, selected="No Dimming")
list_5 = ValueList({"Flourecent": 16, "LED": 8}, selected="LED")
list_6 = ValueList({"UVal_0.4", "UVal_0.3", "UVal_0.2", "UVal_0.1"}, selected="UVal_0.2")
list_7 = ValueList({"Light": "_Light", "Mass": "_Mass"}, selected="Mass")
cluster = Cluster_2(
    S=list_2,
    lpd=list_5,
    dim=list_4,
    hvac=list,
    cost=elec_cost_kwh,
    co2=electricity_emission_factor_co2_kg_kwh,
    mass=list_7,
    con=list_6)

# ----
# WWR and Fixed Shading
south_windows = Slider(60, range=23..90)
shading_depth_m = Slider(0, range=0..2)
shading_depth_m_2 = Slider(0, range=0..2)
north_windows = Slider(60, range=10..90)
east_windows = Slider(40, range=10..90)
west_windows = Slider(40, range=10..90)
shading_depth_m_3 = Slider(1.1, range=0..2)
shading_depth_m_4 = Slider(0.9, range=0..2)
merge = Merge(Data1=north_windows, Data2=east_windows, Data3=south_windows, Data4=west_windows)
merge_2 = Merge(Data1=shading_depth_m, Data2=shading_depth_m_2, Data3=shading_depth_m_3, Data4=shading_depth_m_4)

# ----
# Unit Converter
# Internalized Geometry is
# modeled in meters.
toggle = BooleanToggle(True)
unit = CSUnitScale(
    From="Meters",
    To="ActiveRhinoDocUnits",
    Listener=toggle,
    Input_0_Hidden=False,
    Input_0_Name="From",
    Input_1_Hidden=False,
    Input_1_Name="To",
    Input_2_Hidden=False,
    Input_2_Name="Listener",
    UnitSystem=4)

floorheights = Panel("""5
4
4
3""")
brep_massing = Brep(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)
list_8 = ValueList({"No Dynamic Shading": "None", "Dynamic Exterior Shade": "ExteriorShade"}, selected="Dynamic Exterior Shade")
scale = Scale(Geometry=brep_massing, Center=Point(0, 0, 0), Factor=unit)  # -> Geometry, Transform
multiplication = Multiplication(A=floorheights, B=unit)

# ----
# RUN
button = Button()

list_9 = ValueList({"Solexia - Clear", "SinglePaneClr", "DoublePaneClr", "DoublePaneLoEe2", "DoublePaneLoEe3", "TriplePaneLoE"}, selected="DoublePaneClr")
iteration = Slider(-1, range=-1..25)
reset_count = Button()
floor_cutter = FloorCutter(BuildingVolume=scale.Geometry, FloorHeights=multiplication)
multiplication_2 = Multiplication(A=merge_2, B=unit)
multiplication_3 = Multiplication(A=Slider(10, range=0..30), B=unit)
winshdgen = WinShdGen(zone_geometry=floor_cutter, A=multiplication_3, wwr=merge, L=multiplication_2)  # -> T, T_2
cluster_2 = Cluster_3(cons=list_9, shading=list_8)
name_increment = GhPythonScript(reset_count=reset_count, run=button)  # -> out, this_name, name_list
# ---------- name_increment: Python ----------
__author__ = "Solemma LLC"
__version__ = "2020.10.09"

import os
import rhinoscriptsyntax as rs

os.chdir(os.path.expanduser('~'))

if reset_count and os.path.isfile('iterations.txt'):
    os.remove('iterations.txt')

if os.path.isfile('iterations.txt'):
    recorded_data = True
    with open('iterations.txt', 'r') as f:
        n = int( f.readline().rstrip() )
else:
    recorded_data = False

if recorded_data:
    this_name = 'iter_' + str(n + 1)
    name_list = ['iter_' + str(i + 1) for i in range(n + 1)]
    if run:
        this_name = 'iter_' + str(n + 2) 
        name_list.append(this_name)
else:
    this_name = 'iter_1'
    name_list = ['iter_1']
# ---------- end name_increment ----------
timer = Timer(Interval=5000, TimerInterval=5000, Target=name_increment)
item = ListItem(List=name_increment.name_list, Index=iteration, Wrap=True)
track_files = GhPythonScript(run=button)  # -> out
# ---------- track_files: Python ----------
__author__ = "Solemma LLC"
__version__ = "2020.10.11"

import rhinoscriptsyntax as rs
import os

os.chdir(os.path.expanduser('~'))

recorded_data = False

if run:
    if os.path.isfile('iterations.txt'):
        recorded_data = True
        with open('iterations.txt', 'r') as f:
            n = int( f.readline().rstrip() )
    with open('iterations.txt', 'w') as f:
        if recorded_data:
            f.write(str(n + 1))
        else:
            f.write('0')
# ---------- end track_files ----------
flatten = FlattenTree(Tree=name_increment.name_list, Path="{0}")
panel = Panel(flatten)
concat = Concatenate(FragmentA="EUI", FragmentB=" - ", FragmentC=item)
python = GhPythonScript(x=panel)  # -> a; inputs x: list
# ---------- python: Python ----------
__author__ = "ajakubiec"
__version__ = "2020.10.11"

import rhinoscriptsyntax as rs

a = "0 to " + str(len(x))
# ---------- end python ----------
concat_2 = Concatenate(FragmentA="Loads", FragmentB=" - ", FragmentC=item)

# ----
# Context Geometry
# Source: Urbano.io
brep_context = Brep([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])

scale_2 = Scale(Geometry=brep_context, Center=Point(0, 0, 0), Factor=unit)  # -> Geometry, Transform

preview = CustomPreview(Geometry=scale_2.Geometry, Material=ColourSwatch(SwatchColor=RGB(224, 224, 224)))

cluster_3 = Cluster_4(G=scale.Geometry, num=unit, scene=scale_2.Geometry)

# ----
# Preview
cluster_4 = Cluster(brep=winshdgen.T)
cluster_5 = Cluster(brep=cluster_3)
preview_2 = CustomPreview(Geometry=cluster_5, Material=ColourSwatch(SwatchColor=RGB(240, 117, 117)))
preview_3 = CustomPreview(Geometry=winshdgen.T_2, Material=ColourSwatch(SwatchColor=RGB(48, 48, 48)))
preview_4 = CustomPreview(Geometry=floor_cutter, Material=ColourSwatch(SwatchColor=RGBA(217, 217, 217, 70)))
preview_5 = CustomPreview(Geometry=cluster_4, Material=ColourSwatch(SwatchColor=RGBA(31, 173, 224, 114)))

# ----
# Model Setup
intersector = Intersector(Brep=floor_cutter)
zone = ThermalZone(Brep=intersector, Settings=cluster)  # -> Zones, Settings
shading = Shading(Surface=flatten([winshdgen.T_2, cluster_3]), Schedule="AllOff")
window = Window(Surface=winshdgen.T, Settings=cluster_2, Settings_JSON="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")  # -> Window, Settings
networker = Networker(
    Zones=zone.Zones,
    Windows=window.Window,
    Shading=shading,
    preview_displayAdia=True,
    preview_displayExtFloor=True,
    preview_displayFacades=True,
    preview_displayGround=True,
    preview_displayParts=True,
    preview_displayRoofs=True,
    preview_displayShade=True,
    preview_displaySlabs=True,
    preview_displayWins=True)
run_e = RunCSEnergyModel(
    Model=networker,
    Name=item,
    Directory="C:\Temp\SimulationGame",
    Location=list_3,
    Run=button,
    settings="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")  # -> Model, Settings, Result

energy_results = LoadCSRResultFile(ThermalModel=run_e.Model, Mode=2, Toggle=Toggle(True))  # -> TotalEUI, Baseline, TotalCO2, TotalCost, FloorArea, Data, Labels, Months, Colors, CSR
energy_results_2 = LoadCSRResultFile(ThermalModel=run_e.Model, Mode=0, Toggle=Toggle(True))  # -> TotalEUI, Baseline, TotalCO2, TotalCost, FloorArea, Data, Labels, Months, Colors, CSR
ma = MassAddition(Input=energy_results_2.Data)  # -> Result, PartialResults
multiplication_4 = Multiplication(A=energy_results_2.FloorArea, B=ma.Result)
dispatch = Dispatch(List=multiplication_4, DispatchPattern=button)  # -> ListA, ListB
rec = DataRecorder(dispatch.ListA, DataLimit=-10, RecordData=True)
xyplot = XYPlot(
    Type=2,
    Width="800",
    Height=450,
    Title="Operational Carbon",
    Y_title="[kgCO2eqv]",
    X_labels=panel,
    X_rot=0,
    Y_data=rec,
    Colors=energy_results_2.Colors,
    Names=energy_results_2.Labels,
    Domain=python,
    Range="800000",
    Show_xgrid=False,
    Show_ygrid=True,
    Legend=0)
xyplot_2 = XYPlot(
    Type=2,
    Width="800",
    Height=450,
    Title=concat_2,
    Y_title="[kWh]",
    X_labels=energy_results.Months,
    X_rot=0,
    Y_data=energy_results.Data,
    Colors=energy_results.Colors,
    Names=energy_results.Labels,
    Show_xgrid=False,
    Show_ygrid=True,
    Legend=0)
xyplot_3 = XYPlot(
    Type=2,
    Width="800",
    Height=450,
    Title=concat,
    Y_title="[kWh/m2/yr]",
    X_labels=energy_results_2.Months,
    X_rot=0,
    Y_data=energy_results_2.Data,
    Colors=energy_results_2.Colors,
    Names=energy_results_2.Labels,
    Show_xgrid=False,
    Show_ygrid=True,
    Legend=0)
eval = Evaluate(F="Round(x,1)", x=energy_results_2.TotalEUI)
eval_2 = Evaluate(F="Round(x,1)", x=energy_results_2.Baseline)
eval_3 = Evaluate(F="Round(x,1)", x=energy_results_2.TotalCost)
eval_4 = Evaluate(F="Round(x,1)", x=energy_results_2.TotalCO2)
kg_co2_m2_a = Panel(eval_4)
aia_site_eui_baseline_kwh_pe_m2_a = Panel(eval_2)
m2_a = Panel(eval_3)
site_eui_kwh_m2_a = Panel(eval)

# ==== cluster Cluster
brep = ClusterInput()
brep_2 = Brep(brep)
area = Area(Geometry=brep_2)  # -> Area, Centroid
evalsrf = EvaluateSurface(Surface=brep_2, Point=area.Centroid)  # -> Point, Normal, UDirection, VDirection, Frame
move = Move(Geometry=brep_2, Motion=expr("x*0.01", evalsrf.Normal))  # -> Geometry, Transform
G = ClusterOutput(move.Geometry)

# ==== cluster Cluster_2
S = ClusterInput()
zonetemplate = GetZoneTemplate(SearchZoneTemplate=S, Selection="Residential")
item = ListItem(List=zonetemplate, Index=0, Wrap=True)
lpd = ClusterInput()
dim = ClusterInput()
hvac = ClusterInput()
cost = ClusterInput()
co2 = ClusterInput()
mass = ClusterInput()
con = ClusterInput()
c_script = CSharpScript(
    set=item,
    lpd=lpd,
    dim=dim,
    hvac=hvac,
    cost=cost,
    co2=co2,
    mass=mass,
    con=con,
    Reference="C:\Program Files\Solemma\ClimateStudio\bin\ClimateStudioLib.dll")  # -> out, SET; inputs lpd: Double, dim: String, hvac: String, cost: Double, co2: Double, mass: String, con: String
# ---------- c_script: C# usings ----------
using CSEnergyLib.LibraryObjects;
# ---------- c_script: C# ----------
    var settings = set as CSZoneDefinition;

    settings.Loads.LightingPowerDensity = lpd;
    settings.Loads.DimmingType = dim == "Off" ? DimmingItem.Off : DimmingItem.Continuous;

    settings.CostEmissions.HeatingCO2 = settings.CostEmissions.CoolingCO2 = settings.CostEmissions.HotWaterCO2 = settings.CostEmissions.ElectricityCO2 = co2;
    settings.CostEmissions.HeatingCost = settings.CostEmissions.CoolingCost = settings.CostEmissions.HotWaterCost = settings.CostEmissions.ElectricityCost = cost;

    var hv = hvac.Split(',');

    settings.Conditioning.HeatingCOP = double.Parse(hv[0]);
    settings.HotWater.DomHotWaterCOP = double.Parse(hv[0]);
    settings.Conditioning.CoolingCOP = double.Parse(hv[1]);
    settings.Conditioning.HeatRecoveryType = hv[1] == "None" ? HeatRecoveryItem.None : HeatRecoveryItem.Enthalpy;


    settings.Constructions.SlabConstruction = "Slab" + mass;
    settings.Constructions.PartitionConstruction = "Partition" + mass;

    settings.Constructions.RoofConstruction = con + mass;
    settings.Constructions.FacadeConstruction = con + mass;
    settings.Constructions.ExternalFloorConstruction = con + mass;
    settings.Constructions.GroundSlabConstruction = con + mass;
    settings.Constructions.GroundWallConstruction = con + mass;


    SET = settings;
# ---------- end c_script ----------
set = ClusterOutput(c_script.SET)

# ==== cluster Cluster_3
shading = ClusterInput()
cons = ClusterInput()
window_settings = WindowSettings(
    Name="noName",
    WindowType="External",
    WindowConstruction=cons,
    Shading=shading,
    ShadeAvailibilitySchedule="AllOn",
    ShadeSetPoint=100,
    ShadeTransmittance=0.5,
    ZoneMixingOnOff=False,
    FlowRate=0.1,
    DeltaT=0.1,
    MixingAvailibilitySchedule="AllOn",
    OperableArea=0.8,
    DischargeCoefficient=0.65,
    TemperatureSetpoint=20,
    VentilationControl="Temperature",
    WindowAvailibility="AllOn")
set = ClusterOutput(window_settings)

# ==== cluster Cluster_4
G = ClusterInput()
num = ClusterInput()
volume = Volume(Geometry=G)  # -> Volume, Centroid
num_2 = Number(num)
scene = ClusterInput()
pdecon = Deconstruct(Point=volume.Centroid)  # -> XComponent, YComponent, ZComponent
multiplication = Multiplication(A="1", B=num_2)
multiplication_2 = Multiplication(A="60", B=num_2)
pt = ConstructPoint(XCoordinate=pdecon.XComponent, YCoordinate=pdecon.YComponent, ZCoordinate=multiplication)
shading_mask = ShadingMask(Pt=pt, Dir=Vector(0, 1, 0), Radius=multiplication_2, HAng="1", VAng=5, Scene=scene, Full=True, Mode=2)
mask = ClusterOutput(shading_mask)

# ==== cluster WinShdGen
zone_geometry = ClusterInput()
debrep = DeconstructBrep(ZoneGeometry=zone_geometry)  # -> Faces, Edges, Vertices
A = ClusterInput()
area = Area(Geometry=debrep.Faces)  # -> Area, Centroid
evalsrf = EvaluateSurface(Surface=debrep.Faces, Point=area.Centroid)  # -> Point, Normal, UDirection, VDirection, Frame
Z = UnitZ(Factor=1)
dprod = DotProduct(VectorA=evalsrf.Normal, VectorB=Z, Unitize=False)
wwr = ClusterInput()  # WWR (N,E,S,W)
abs = Absolute(Value=dprod)
smaller = SmallerThan(FirstNumber=abs, SecondNumber=".9")  # -> SmallerThan, OrEqualTo
dispatch = Dispatch(List=debrep.Faces, DispatchPattern=smaller.SmallerThan)  # -> ListA, ListB
srf = Surface(dispatch.ListA)
cluster = Cluster_7(srf=srf)
srf_2 = Surface(flatten(cluster))
multiplication = Multiplication(A=A, B=".999")
dim = Dimensions(Surface=srf_2)  # -> UDimension, VDimension
c_script = CSharpScript(u=dim.UDimension, v=dim.VDimension, x=multiplication)  # -> out, U, V; inputs u: Double, v: Double, x: Double
# ---------- c_script: C# ----------
    U = ((int) (u / x)) < 1 ? 1 : ((int) (u / x));
    V = ((int) (v / x)) < 1 ? 1 : ((int) (v / x));
# ---------- end c_script ----------
divide = DivideDomain²(Domain=srf_2, UCount=c_script.U, VCount=c_script.V)  # -> simplify(Segments)
subsrf = Isotrim(Surface=simplify(graft(srf_2)), Domain=simplify(divide))
flip = Flip(Surface=subsrf, Guide=simplify(graft(cluster)))  # -> Surface, Result
area_2 = Area(Geometry=flip.Surface)  # -> Area, Centroid
evalsrf_2 = EvaluateSurface(Surface=flip.Surface, Point=area_2.Centroid)  # -> Point, Normal, UDirection, VDirection, Frame
vdis = VectorDisplay(Anchor=area_2.Centroid, Vector=evalsrf_2.Normal)
item = ListItem(List=wwr, Index="0", Wrap=True)
item_2 = ListItem(List=wwr, Index="1", Wrap=True)
item_3 = ListItem(List=wwr, Index="2", Wrap=True)
item_4 = ListItem(List=wwr, Index="3", Wrap=True)
Y = UnitY(Factor=1)
X = UnitX(Factor=1)
Y_2 = UnitY(Factor="-1")
X_2 = UnitX(Factor="-1")
L = ClusterInput()
cluster_2 = Cluster_5(S=flip.Surface, dir=Y, wwr=item)
cluster_3 = Cluster_5(S=flip.Surface, dir=X, wwr=item_2)
cluster_4 = Cluster_5(S=flip.Surface, dir=Y_2, wwr=item_3)
cluster_5 = Cluster_5(S=flip.Surface, dir=X_2, wwr=item_4)
geo_e = Geometry(cluster_3)
geo_s = Geometry(cluster_4)
geo_n = Geometry(cluster_2)
geo_w = Geometry(cluster_5)
merge = Merge(Data1=geo_n, Data2=geo_e, Data3=geo_s, Data4=geo_w)
clean = CleanTree(RemoveNulls=True, RemoveInvalid=True, RemoveEmpty=False, Tree=merge)  # -> flatten(Tree)
T = ClusterOutput(clean)
panel = Panel("0")
item_5 = ListItem(List=L, Index="0", Wrap=True)
item_6 = ListItem(List=L, Index="1", Wrap=True)
item_7 = ListItem(List=L, Index="3", Wrap=True)
item_8 = ListItem(List=L, Index="2", Wrap=True)
cluster_6 = Cluster_6(B=geo_n, B_2=item_5)
cluster_7 = Cluster_6(B=geo_e, B_2=item_6)
cluster_8 = Cluster_6(B=geo_w, B_2=item_7)
cluster_9 = Cluster_6(B=geo_s, B_2=item_8)
geo = Geometry(cluster_6)
geo_2 = Geometry(cluster_7)
geo_3 = Geometry(cluster_8)
geo_4 = Geometry(cluster_9)
merge_2 = Merge(Data1=geo, Data2=geo_2, Data3=geo_4, Data4=geo_3)
clean_2 = CleanTree(RemoveNulls=True, RemoveInvalid=True, RemoveEmpty=False, Tree=merge_2)  # -> flatten(Tree)
T_2 = ClusterOutput(clean_2)

# ==== cluster Cluster_5
wwr = ClusterInput()  # WWR
dir = ClusterInput()  # Dir
S = ClusterInput()  # S

# ----
# north south gets priority
Y = UnitY(Factor=1)
dprod = DotProduct(VectorA=dir, VectorB=Y, Unitize=False)
abs = Absolute(Value=dprod)
int = Integer(abs)
item = ListItem(List=[".71", ".7"], Index=int, Wrap=True)

area = Area(Geometry=S)  # -> Area, Centroid
evalsrf = EvaluateSurface(Surface=S, Point=area.Centroid)  # -> Point, Normal, UDirection, VDirection, Frame
dprod_2 = DotProduct(VectorA=evalsrf.Normal, VectorB=dir, Unitize=False)
larger = LargerThan(FirstNumber=dprod_2, SecondNumber=item)  # -> LargerThan, OrEqualTo
panel = Panel(evalsrf.Normal)
dispatch = Dispatch(List=S, DispatchPattern=larger.LargerThan)  # -> WallsNORTH, ListB
wall_geometry = Geometry(dispatch.WallsNORTH)

# ---- group: User-Defined WWR Scale
division = Division(NorthScaleInput=wwr, B="100")

# ---- group: Centroids of Walls
area_2 = Area(Geometry=wall_geometry)  # -> Area, Centroid

# ----
sqrt = SquareRoot(Value=division)
scale = Scale(Geometry=wall_geometry, Center=area_2.Centroid, Factor=sqrt)  # -> flatten(NORTHWindows), Transform
area_3 = Area(Geometry=scale.NORTHWindows)  # -> Area, Centroid; disabled
division_2 = Division(A=area_3.Area, B=area_2.Area)  # disabled
panel_2 = Panel(division_2)  # disabled
north_windows = ClusterOutput(scale.NORTHWindows)

# ==== cluster Cluster_6
B = ClusterInput()
B_2 = ClusterInput()
area = Area(Geometry=B)  # -> Area, Centroid
evalsrf = EvaluateSurface(Surface=B, Point=area.Centroid)  # -> Point, Normal, UDirection, VDirection, Frame
unit = UnitVector(Vector=evalsrf.Normal)
multiplication = Multiplication(A=unit, B=B_2)
extr = Extrude(Base=B, Direction=multiplication)
debrep = DeconstructBrep(Brep=extr)  # -> Faces, Edges, Vertices
Z = UnitZ(Factor=1)
area_2 = Area(Geometry=debrep.Faces)  # -> Area, Centroid
evalsrf_2 = EvaluateSurface(Surface=debrep.Faces, Point=area_2.Centroid)  # -> Point, Normal, UDirection, VDirection, Frame
dprod = DotProduct(VectorA=evalsrf_2.Normal, VectorB=Z, Unitize=False)
larger = LargerThan(FirstNumber=dprod, SecondNumber="0.8")  # -> LargerThan, OrEqualTo
cull = CullPattern(List=debrep.Faces, CullPattern=larger.LargerThan)  # -> flatten(List)
L = ClusterOutput(cull)

# ==== cluster Cluster_7
srf = ClusterInput()
srf_2 = Surface(srf)
crv = Curve(srf_2)
crv_2 = Curve(srf_2)  # disabled
srf_3 = Surface(crv_2)  # disabled
area = Area(Geometry=srf_2)  # -> Area, Centroid; disabled
srf_4 = Surface(crv)
area_2 = Area(Geometry=srf_3)  # -> Area, Centroid; disabled
flip = Flip(Surface=srf_4, Guide=srf_2)  # -> Surface, Result
evalsrf = EvaluateSurface(Surface=srf_2, Point=area.Centroid)  # -> Point, Normal, UDirection, VDirection, Frame; disabled
evalsrf_2 = EvaluateSurface(Surface=srf_3, Point=area_2.Centroid)  # -> Point, Normal, UDirection, VDirection, Frame; disabled
panel = Panel(flip.Result)
vdis = VectorDisplay(Anchor=area_2.Centroid)  # disabled
dprod = DotProduct(VectorA=evalsrf.Normal, VectorB=evalsrf_2.Normal, Unitize=False)  # disabled
vdis_2 = VectorDisplay(Anchor=area.Centroid, Vector=expr("x*10", evalsrf.Normal))  # disabled
panel_2 = Panel(".9")  # disabled
smaller = SmallerThan(FirstNumber=dprod, SecondNumber=panel_2)  # -> SmallerThan, OrEqualTo; disabled
dispatch = Dispatch(List=srf_3, DispatchPattern=smaller.SmallerThan)  # -> ListA, ListB; disabled
flip_2 = Flip(Surface=dispatch.ListA)  # -> Surface, Result; disabled
srf_5 = Surface(flatten([flip_2.Surface, dispatch.ListB]))  # disabled
S = ClusterOutput(flip.Surface)
